# Grasshopper definition 02_crb15000_moveit_simulation_py3_2.ghx (Grasshopper 1.0.8)

reload = Button()
path = Python3Script()  # -> HERE, DATA, ROBOT_DESCRIPTION
# ---------- path: Python ----------
import os

HERE = os.path.dirname(ghdoc.Path)
DATA = os.path.abspath(os.path.join(HERE, "..", "data"))
ROBOT_DESCRIPTION = os.path.abspath(os.path.join(DATA, "robot_description"))

print(HERE)
print(DATA)
print(ROBOT_DESCRIPTION)
# ---------- end path ----------
py3 = Python3Script(reload=reload)
# ---------- py3: Python ----------
from compas_ghpython import unload_modules

if reload:
    unload_modules("fabtory_fabrication_control")
    unload_modules("compas_rrc")
    unload_modules("crb15000_control")
# ---------- end py3 ----------

# ----
# ROS client
ip = ValueList({"127.0.0.1", "192.168.0.4"}, selected="127.0.0.1")
robot_port = ValueList({"9090", "30101"}, selected="9090")
ros = Python3Script(ip=ip, port=robot_port, connect=Toggle(True))  # -> ros_client, is_connected
# ---------- ros: Python ----------
from ghpythonlib.componentbase import executingcomponent as component
from scriptcontext import sticky as st

from compas_fab.backends import RosClient
#from compas_fab.ghpython.components import create_id



ros_client = None

ip = ip or '127.0.0.1'
port = port or 9090

key = 'ros_client'
ros_client = st.get(key, None)

if ros_client:
    st[key].close()
if connect:
    st[key] = RosClient(ip, port)
    st[key].run(5)

ros_client = st.get(key, None)
is_connected = ros_client.is_connected if ros_client else False
print(ros_client, is_connected)
# ---------- end ros ----------
is_connected = Panel(ros.is_connected)

py3_2 = Python3Script()  # -> out, a
# ---------- py3_2: Python ----------
import sys

# Print welke Python interpreter wordt gebruikt
print("Python executable:")
print(sys.executable)
print()

# Functie om locatie van een package te checken
def print_package_location(pkg_name):
    try:
        pkg = __import__(pkg_name)
        print(f"{pkg_name} is geïnstalleerd op:")
        print(pkg.__file__)
    except ModuleNotFoundError:
        print(f"{pkg_name} is NIET geïnstalleerd.")
    print()

# Check de belangrijkste packages
print_package_location("compas")
print_package_location("compas_fab")
print_package_location("compas_rrc")
# ---------- end py3_2 ----------

# ----
# Configuration
# Forward kinematics
number_slider = Slider(0, range=-180..180)
jp = Python3Script()  # -> configuration_values
# ---------- jp: Python ----------
import math
joint_values = [-3.136, -0.328, -1.218, 3.129, 0.852, 0.008]
#joint_values = [math.degrees(j) for j in joint_values]
#joint_positions = [0] * 6

joint_values = [0,0,0,0,0,0]

configuration_values = joint_values
# ---------- end jp ----------
forward_kinematics = Python3Script(
    reset_configuration=Button(),
    configuration_values=jp,
    a_a1=number_slider,
    a_a2=Slider(0, range=-90..150),
    a_a3=Slider(0, range=-180..180),
    a_a4=Slider(0, range=-400..400),
    a_a5=Slider(-4.5, range=-125..120),
    a_a6=Slider(0, range=-400..400))  # -> full_configuration
# ---------- forward_kinematics: Python ----------
import math
import Grasshopper
import copy
from compas_robots.model import Joint
from compas_robots import Configuration

if reset_configuration:
    j = 0
    for i in range(ghenv.Component.Params.Input.Count):
        nslider = ghenv.Component.Params.Input[i].Sources[0]
        if nslider.GetType() == Grasshopper.Kernel.Special.GH_NumberSlider:
            nslider.TrySetSliderValue(configuration_values[j])
            j += 1


if robot:
    joint_positions = [a_a1, a_a2, a_a3, a_a4, a_a5, a_a6]
    print(joint_positions)
    joint_positions_degrees = copy.deepcopy(joint_positions)
    joint_types = robot.get_configurable_joint_types()
    print(joint_types)
    for i, joint_type in enumerate(joint_types):
        if joint_type == Joint.REVOLUTE:
            joint_positions[i] = math.radians(joint_positions[i])
        if joint_type == Joint.PRISMATIC:
            joint_positions[i] = joint_positions[i]
    full_configuration = Configuration(joint_positions, joint_types)
    print(full_configuration)
# ---------- end forward_kinematics ----------

# ----
# Tool
panel = Panel("Attach a custom tool")
list = ValueList({"measurement_tool": 0, "concrete_extruder": 1}, selected="measurement_tool")
remove = Button()
add = Button()
tools = Tools(G=list)

# ----
# Load Model
# Load robot from local package
load = Button()
list_2 = ValueList({"abb_crb15000"}, selected="abb_crb15000")
units = ValueList({"m": 1, "cm": 100, "mm": 1000}, selected="m")

# ----
# Robot Model
panel_2 = Panel("abb_crb15000_5_95.srdf")
abb = Python3Script(ros_client=ros.ros_client, connect=Toggle(True))  # -> out, abb_client
# ---------- abb: Python ----------
import compas_rrc as rrc

if ros_client:
    if ros_client.is_connected and connect: 
        # Create ABB Client
        abb_client = rrc.AbbClient(ros_client, '/rob1')
# ---------- end abb ----------

load_model = Python3Script(
    path=path.ROBOT_DESCRIPTION,
    package=list_2,
    urdf_name="abb_crb15000_5_95.urdf",
    srdf_name=panel_2,
    scale_factor=units,
    load=load)  # -> robot
# ---------- load_model: Python ----------
import os
from scriptcontext import sticky as st
import compas
from compas_robots import RobotModel
from compas_robots.resources import LocalPackageMeshLoader
from compas.scene import SceneObject
from compas_fab.robots import Robot
from compas_fab.robots import RobotSemantics
#from compas_fab.ghpython import RobotArtist

packages = ["abb_crb15000_support", "abb_end_effectors", "abb_crb15000"]
loaders = []

for package in packages:
    loaders.append(LocalPackageMeshLoader(path, package))

#path directory
package_path = os.path.join(path, package)
print(package_path)

urdf_filename = os.path.join(package_path, "urdf", urdf_name)
srdf_filename = os.path.join(package_path, srdf_name)

assert os.path.isfile(urdf_filename)
assert os.path.isfile(srdf_filename)

compas.PRECISION = '12f'

# store robot in component
guid = str(ghenv.Component.InstanceGuid)
robot_key = "robot_" + guid

if robot_key not in st:
    st[robot_key] = None

#load robot model from urdf
if load:
    model = RobotModel.from_urdf_file(urdf_filename)
    model.load_geometry(*loaders)
    sceneobject = SceneObject(item = model)
    semantics = RobotSemantics.from_srdf_file(srdf_filename, model)
    robot = Robot(model, sceneobject, semantics, client=None)

    st[robot_key] = robot
robot = st[robot_key]

#vizualize robot in the right scale of your environment
robot.scale(scale_factor)
# ---------- end load_model ----------

attach_remove = Python3Script(robot=load_model, tool=tools, attach=add, remove=remove)  # -> out, bang
# ---------- attach_remove: Python ----------
if attach:
    robot.attach_tool(tool)
if remove:
    robot.detach_tool()
# ---------- end attach_remove ----------

set = Python3Script(robot=load_model, ros_client=ros.ros_client, abb_client=abb.abb_client)  # -> out, robot, main_group_name
# ---------- set: Python ----------
if robot and ros_client and abb_client:
    robot.ros_client = ros_client
    robot.abb_client = abb_client

    semantics = robot.semantics
    main_group_name = robot.semantics.main_group_name
    
print(robot.model.get_link_by_name("tool0"))
# ---------- end set ----------
robot_info = Panel(set.out)

# ----
# Inverse kinematics
py3_3 = Python3Script(robot=set.robot)  # -> configuration
# ---------- py3_3: Python ----------
from compas_robots import Configuration

if robot:
    types = robot.get_configurable_joint_types()
    values = [0] * len(types)
    configuration = Configuration(values, types)
    print(configuration)
    print(robot.get_configurable_joint_names())
# ---------- end py3_3 ----------
x_axis = Curve(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)
y_axis = Curve(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)
fk_configuration = Data(forward_kinematics)
go_to_start_configuration = BooleanToggle(False)
list_3 = ValueList({"0", "1"}, selected="0")
avoid_collisions = BooleanToggle(False)
plane = Python3Script(plane_axes=[x_axis, y_axis])  # -> plane; inputs plane_axes: list of Line
# ---------- plane: Python ----------
import Rhino.Geometry as rg

x_axis, y_axis = plane_axes

x_axis = rg.Line(x_axis.From, x_axis.To)
y_axis = rg.Line(y_axis.From, y_axis.To)

if x_axis.From.DistanceTo(y_axis.From) < 0.01:
    origin = x_axis.From
    xvec = x_axis.Direction
    yvec = y_axis.Direction
elif x_axis.To.DistanceTo(y_axis.To) < 0.01:
    origin = x_axis.To
    xvec = -x_axis.Direction
    yvec = -y_axis.Direction
elif x_axis.From.DistanceTo(y_axis.To) < 0.01:
    origin = x_axis.From
    xvec = x_axis.Direction
    yvec = -y_axis.Direction
elif x_axis.To.DistanceTo(y_axis.From) < 0.01:
    origin = x_axis.To
    xvec = -x_axis.Direction
    yvec = y_axis.Direction

plane = rg.Plane(origin, xvec, yvec)
# ---------- end plane ----------
compute = BooleanToggle(True)
filter = StreamFilter(Gate=list_3, Stream0=fk_configuration, Stream1=py3_3)
inverse_kinematics = Python3Script(
    compute=compute,
    robot=set.robot,
    group=set.main_group_name,
    plane=plane,
    start_configuration=filter,
    go_to_start_configuration=go_to_start_configuration,
    avoid_collisions=avoid_collisions)  # -> out, ik_configuration, t0cp
# ---------- inverse_kinematics: Python ----------
from __future__ import print_function
import logging
from scriptcontext import sticky as st

from compas.geometry import Frame
#from compas_ghpython.artists import Artist
from compas_rhino.conversions import frame_to_rhino

LOGGER = logging.getLogger('roslibpy')

#vizualize t0cf
if robot.attached_tool:
    t0cf = Frame(plane.Origin, plane.XAxis, plane.YAxis)
    t0cf = robot.from_tcf_to_t0cf([t0cf])[0]
    t0cp = frame_to_rhino(t0cf)
    print (t0cf)


if compute:
    if robot.attached_tool:
        tool_attached = True
    else:
        tool_attached = False

    robot.client = robot.ros_client
    if go_to_start_configuration:
        ik_configuration = start_configuration
    else:
        frame = Frame(plane.Origin, plane.XAxis, plane.YAxis)
        if tool_attached:
            tool_frame = robot.from_tcf_to_t0cf([frame])[0]
        else:
            tool_frame = frame

        ik_configuration = robot.inverse_kinematics(tool_frame,
                                                      start_configuration,
                                                      group=group,
                                                      options={
                                                        'avoid_collisions':avoid_collisions,
                                                        'return_full_configuration':True,
                                                      })        
    #group_configuration = robot.get_group_configuration(group, ik_configuration)
    #print (group_configuration)
    st["ik_configuration"] = ik_configuration

ik_configuration = st["ik_configuration"] 
print(ik_configuration)
# ---------- end inverse_kinematics ----------
py3_4 = Python3Script(planes=inverse_kinematics.t0cp, scale=Slider(0.2, range=0..1))  # -> P, V, C, W; inputs planes: list
# ---------- py3_4: Python ----------
from System.Drawing import Color
from compas.geometry import Frame
from compas_rhino.conversions import frame_to_rhino

red = Color.FromArgb(255, 0, 0)
green = Color.FromArgb(0, 255, 0)
blue = Color.FromArgb(0, 0, 255)

P = []
V = []
C = []

scale = float(scale)

for plane in planes:
    if not plane:
        continue
    P += [plane.Origin] * 3
    V.append(plane.XAxis * scale)
    V.append(plane.YAxis * scale)
    V.append(plane.ZAxis * scale)
    C += [red, green, blue]

W = 3
# ---------- end py3_4 ----------
out = Panel(inverse_kinematics.out)
vdisex = VectorDisplayEx(Point=py3_4.P, Vector=py3_4.V, Colour=py3_4.C, Width=py3_4.W)

list_4 = ValueList({"0 forward_kinematics": 0, "1 inverse_kinematics": 1}, selected="0 forward_kinematics")
ik_configuration = Data(inverse_kinematics.ik_configuration)
fk_configuration_2 = Data(forward_kinematics)
filter_2 = StreamFilter(Gate=list_4, Stream0=fk_configuration_2, Stream1=ik_configuration)

# ----
# Visualisation
show_end_effector_frame = BooleanToggle(True)
show_base_frame = BooleanToggle(False)
show_collision = BooleanToggle(False)
show_frames = BooleanToggle(False)
show_visual = BooleanToggle(True)
show_acm = BooleanToggle(False)
robot_visualize = Python3Script(
    robot=set.robot,
    group=set.main_group_name,
    configuration=filter_2,
    redraw=attach_remove.bang,
    show_visual=show_visual,
    show_collision=show_collision,
    show_frames=show_frames,
    show_base_frame=show_base_frame,
    show_end_effector_frame=show_end_effector_frame,
    show_acm=show_acm)  # -> visual, collision, attached_meshes, frames, base_frame, ee_frame
# ---------- robot_visualize: Python ----------
"""
Visualizes the robot.

COMPAS FAB v0.19.1
"""
from compas.geometry import Frame
from compas_rhino.conversions import frame_to_rhino_plane
from compas.geometry import Transformation


if robot:
    show_visual = True if show_visual is None else show_visual
    configuration = configuration or robot.zero_configuration()

    robot.update(configuration, visual=show_visual, collision=show_collision)
    compas_frames = robot.transformed_frames(configuration, group)
    print(len(compas_frames))

    if show_visual:
        visual = robot.draw_visual()

    if show_collision:
        collision = robot.draw_collision()

    if show_base_frame:
        base_compas_frame = compas_frames[0]
        base_frame = frame_to_rhino_plane(base_compas_frame)

    if show_end_effector_frame:
        ee_compas_frame = robot.forward_kinematics(
            configuration, group, options=dict(solver="model", link="tool0")
        )
        print(ee_compas_frame)
        print(robot.get_end_effector_frame())
        if robot.attached_tool:
            ee_compas_frame = robot.from_t0cf_to_tcf([ee_compas_frame])[0]
        ee_frame = frame_to_rhino_plane(ee_compas_frame)

    if show_frames:
        frames = []
        for compas_frame in compas_frames[1:]:
            frame = frame_to_rhino_plane(compas_frame)
            frames.append(frame)

#    if show_acm:
#        attached_meshes = []
#        for acm in attached_collision_meshes:
#            frame = robot.forward_kinematics(configuration, options=dict(solver='model', link_name=acm.link_name))
#            T = Transformation.from_frame_to_frame(Frame.worldXY(), frame)
#            mesh = acm.collision_mesh.mesh.transformed(T)
#            attached_meshes.append(Artist(mesh).draw())

print(visual, collision, attached_meshes, frames, base_frame, ee_frame)
# ---------- end robot_visualize ----------
draw = Python3Script(frames=[robot_visualize.ee_frame, robot_visualize.frames, robot_visualize.base_frame], scale=Slider(0.2, range=0..1))  # -> P, V, C, W; inputs frames: list of Plane
# ---------- draw: Python ----------
from System.Drawing import Color
#from compas_ghpython.artists import FrameArtist
from compas.geometry import Frame
from compas_rhino.conversions import frame_to_rhino


red = Color.FromArgb(255, 0, 0)
green = Color.FromArgb(0, 255, 0)
blue = Color.FromArgb(0, 0, 255)

P = []
V = []
C = []

scale = float(scale)

for plane in frames:
    if not plane:
        continue
    P += [plane.Origin] * 3
    V.append(plane.XAxis * scale)
    V.append(plane.YAxis * scale)
    V.append(plane.ZAxis * scale)
    C += [red, green, blue]

W = 3
# ---------- end draw ----------
geo = Geometry([robot_visualize.visual, robot_visualize.collision, robot_visualize.attached_meshes])
preview = CustomPreview(Geometry=geo, Shader=ColourSwatch(SwatchColor=RGB(207, 157, 160)))
vdisex_2 = VectorDisplayEx(Point=draw.P, Vector=draw.V, Colour=draw.C, Width=draw.W)

# ==== cluster Tools

# ---- group: measurement tool
geo = Geometry(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)
mesh = Mesh(geo)
mjoin = MeshJoin(Meshes=mesh)
xaxis_line = Curve(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)
yaxis_line = Curve(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)
tool = Python3Script(rhmesh=mjoin, xline=xaxis_line, yline=yaxis_line)  # -> tool; inputs rhmesh: Mesh, xline: Line, yline: Line
# ---------- tool: Python ----------
import Rhino.Geometry as rg
import os, math
from compas.geometry import Frame, Rotation
from compas.datastructures import Mesh
from compas_rhino.conversions import mesh_to_compas
#from compas_ghpython.scene import MeshObject
from compas_fab.robots import Tool
#from compas_rhino.scene import RhinoMeshObject

#xaxis = rg.Line(xline.From, xline.To)
#yaxis = rg.Line(yline.PointAtStart, yline.PointAtEnd)
xaxis = xline
yaxis = yline

if xaxis.From.DistanceTo(yaxis.From) < 0.01:
    origin = xaxis.From
    xaxis = xaxis.Direction
    yaxis = yaxis.Direction
elif xaxis.To.DistanceTo(yaxis.To) < 0.01:
    origin = xaxis.To
    xaxis = -xaxis.Direction
    yaxis = -yaxis.Direction
elif xaxis.From.DistanceTo(yaxis.To) < 0.01:
    origin = xaxis.From
    xaxis = xaxis.Direction
    yaxis = -yaxis.Direction
elif xaxis.To.DistanceTo(yaxis.From) < 0.01:
    origin = xaxis.To
    xaxis = -xaxis.Direction
    yaxis = yaxis.Direction

xaxis.Unitize()
yaxis.Unitize()

ee_frame = Frame(origin, xaxis, yaxis)
ee_mesh = mesh_to_compas(rhmesh)

tool = Tool(ee_mesh, ee_frame)
# ---------- end tool ----------

# ---- group: concrete extruder tool
geo_2 = Geometry(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)
mesh_2 = Mesh(geo_2)
mjoin_2 = MeshJoin(Meshes=mesh_2)
yaxis_line_2 = Curve(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)
xaxis_line_2 = Curve(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)
tool_2 = Python3Script(rhmesh=mjoin_2, xline=xaxis_line_2, yline=yaxis_line_2)  # -> tool; inputs rhmesh: Mesh, xline: Line, yline: Line; same code as tool

# ----
G = ClusterInput()
filter = StreamFilter(Gate=G, Stream0=tool, Stream1=tool_2)
s_0 = ClusterOutput(filter)
