# Grasshopper definition 03_crb15000_moveit_simulation_robot_control_py3.ghx (Grasshopper 1.0.8)

reload = Button()
path = Python3Script()  # -> HERE, DATA, ROBOT_DESCRIPTION
# ---------- path: Python ----------
import os

HERE = os.path.dirname(ghdoc.Path)
DATA = os.path.abspath(os.path.join(HERE, "..", "data"))
ROBOT_DESCRIPTION = os.path.abspath(os.path.join(DATA, "robot_description"))

print(HERE)
print(DATA)
print(ROBOT_DESCRIPTION)
# ---------- end path ----------
py = Python3Script(reload=reload)
# ---------- py: Python ----------
from compas_ghpython import unload_modules

if reload:
    unload_modules("fabtory_fabrication_control")
    unload_modules("compas_rrc")
    unload_modules("crb15000_control")
    unload_modules("abb_fabrication_control")
# ---------- end py ----------

# ----
# ROS client
ip = ValueList({"127.0.0.1", "192.168.0.4"}, selected="127.0.0.1")
robot_port = ValueList({"9090", "30101"}, selected="9090")
ros = Python3Script(ip=ip, port=robot_port, connect=Toggle(True))  # -> ros_client, is_connected
# ---------- ros: Python ----------
from ghpythonlib.componentbase import executingcomponent as component
from scriptcontext import sticky as st

from compas_fab.backends import RosClient
#from compas_fab.ghpython.components import create_id



ros_client = None

ip = ip or '127.0.0.1'
port = port or 9090

key = 'ros_client'
ros_client = st.get(key, None)

if ros_client:
    st[key].close()
if connect:
    st[key] = RosClient(ip, port)
    st[key].run(5)

ros_client = st.get(key, None)
is_connected = ros_client.is_connected if ros_client else False
print(ros_client, is_connected)
# ---------- end ros ----------
is_connected = Panel(ros.is_connected)

# ----
# Load robot from ROS
load = Button()
robot = Python3Script(ros_client=ros.ros_client, load=load)  # -> out, robot; inputs prefix: String
# ---------- robot: Python ----------
"""
Load robot directly from ROS.

COMPAS FAB v0.27.0
"""
import Rhino
import scriptcontext
from scriptcontext import sticky as st

scriptcontext.doc = Rhino.RhinoDoc.ActiveDoc

from compas_robots import RobotModel
from compas_robots.ghpython.scene import RobotModelObject
from compas.scene import SceneObject
import compas_robots.ghpython

scriptcontext.doc = ghdoc

key = 'robot'
print(key)
if ros_client and ros_client.is_connected and load:
    # Load URDF from ROS
    robot = ros_client.load_robot(
            load_geometry=True, 
            urdf_param_name= '{}/robot_description'.format(prefix),
            srdf_param_name= '{}/robot_description_semantic'.format(prefix))
    robot.scene_object = SceneObject(item=robot.model)
    # mobile_robot = MobileRobot(robot.model, robot.scene_object, robot.semantics, client=None)
    st[key] = robot


robot = st.get(key, None)
if robot:  # client sometimes need to be restarted, without needing to reload geometry
    robot.client = ros_client
# ---------- end robot ----------

robot_2 = Data(robot.robot)
info = Python3Script(robot=robot_2)  # -> out, main_group_name
# ---------- info: Python ----------
if robot:
    robot.info()
    main_group_name = robot.main_group_name
# ---------- end info ----------
panel = Panel(info.out)

# ----
# Tool
panel_2 = Panel("Attach a custom tool")
list = ValueList({"measurement_tool": 0, "wasp_extruder": 1}, selected="wasp_extruder")
remove = Button()
add = Button()
tools = Tools(G=list)
attach_remove = Python3Script(robot=robot_2, tool=tools, attach=add, remove=remove)  # -> out, bang
# ---------- attach_remove: Python ----------
if attach:
    robot.attach_tool(tool)
if remove:
    robot.detach_tool()
# ---------- end attach_remove ----------

# ----
# Robot Model
abb_client = Python3Script(ros_client=ros.ros_client, connect=Toggle(True))  # -> out, abb_client
# ---------- abb_client: Python ----------
import compas_rrc as rrc

if ros_client:
    if ros_client.is_connected and connect: 
        # Create ABB Client
        abb_client = rrc.AbbClient(ros_client, '/rob1')
# ---------- end abb_client ----------
set = Python3Script(robot=robot_2, ros_client=ros.ros_client, abb_client=abb_client.abb_client)  # -> out, robot, main_group_name
# ---------- set: Python ----------
if robot and ros_client and abb_client:
    robot.ros_client = ros_client
    robot.abb_client = abb_client

    semantics = robot.semantics
    main_group_name = robot.semantics.main_group_name
    
print(robot.model.get_link_by_name("tool0"))
# ---------- end set ----------

# ----
# Configuration
# Forward kinematics
number_slider = Slider(0, range=-180..180)

jp = Python3Script()  # -> configuration_values
# ---------- jp: Python ----------
import math
joint_values = [-3.136, -0.328, -1.218, 3.129, 0.852, 0.008]
#joint_values = [math.degrees(j) for j in joint_values]
#joint_positions = [0] * 6

joint_values = [0,0,0,0,0,0]

configuration_values = joint_values
# ---------- end jp ----------
forward_kinematics = Python3Script(
    robot=set.robot,
    reset_configuration=Button(),
    configuration_values=jp,
    a_a1=number_slider,
    a_a2=Slider(0, range=-90..150),
    a_a3=Slider(0, range=-180..180),
    a_a4=Slider(0, range=-400..400),
    a_a5=Slider(0, range=-125..120),
    a_a6=Slider(0, range=-400..400))  # -> full_configuration
# ---------- forward_kinematics: Python ----------
import math
import Grasshopper
import copy
from compas_robots.model import Joint
from compas_robots import Configuration

if reset_configuration:
    j = 0
    for i in range(ghenv.Component.Params.Input.Count):
        nslider = ghenv.Component.Params.Input[i].Sources[0]
        if nslider.GetType() == Grasshopper.Kernel.Special.GH_NumberSlider:
            nslider.TrySetSliderValue(configuration_values[j])
            j += 1


if robot:
    joint_positions = [a_a1, a_a2, a_a3, a_a4, a_a5, a_a6]
    print(joint_positions)
    joint_positions_degrees = copy.deepcopy(joint_positions)
    joint_types = robot.get_configurable_joint_types()
    print(joint_types)
    for i, joint_type in enumerate(joint_types):
        if joint_type == Joint.REVOLUTE:
            joint_positions[i] = math.radians(joint_positions[i])
        if joint_type == Joint.PRISMATIC:
            joint_positions[i] = joint_positions[i]
    full_configuration = Configuration(joint_positions, joint_types)
    print(full_configuration)
# ---------- end forward_kinematics ----------

# ----
# Inverse kinematics
py3 = Python3Script()  # -> configuration
# ---------- py3: Python ----------
from compas_robots import Configuration

if robot:
    types = robot.get_configurable_joint_types()
    values = [0] * len(types)
    configuration = Configuration(values, types)
    print(configuration)
    print(robot.get_configurable_joint_names())
# ---------- end py3 ----------
x_axis = Curve(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)
y_axis = Curve(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)
fk_configuration = Data(forward_kinematics)
go_to_start_configuration = BooleanToggle(False)
list_2 = ValueList({"0", "1"}, selected="0")
avoid_collisions = BooleanToggle(False)
plane = Python3Script(plane_axes=[x_axis, y_axis])  # -> plane; inputs plane_axes: list of Line
# ---------- plane: Python ----------
import Rhino.Geometry as rg

x_axis, y_axis = plane_axes

x_axis = rg.Line(x_axis.From, x_axis.To)
y_axis = rg.Line(y_axis.From, y_axis.To)

if x_axis.From.DistanceTo(y_axis.From) < 0.01:
    origin = x_axis.From
    xvec = x_axis.Direction
    yvec = y_axis.Direction
elif x_axis.To.DistanceTo(y_axis.To) < 0.01:
    origin = x_axis.To
    xvec = -x_axis.Direction
    yvec = -y_axis.Direction
elif x_axis.From.DistanceTo(y_axis.To) < 0.01:
    origin = x_axis.From
    xvec = x_axis.Direction
    yvec = -y_axis.Direction
elif x_axis.To.DistanceTo(y_axis.From) < 0.01:
    origin = x_axis.To
    xvec = -x_axis.Direction
    yvec = y_axis.Direction

plane = rg.Plane(origin, xvec, yvec)
# ---------- end plane ----------
compute = BooleanToggle(True)
filter = StreamFilter(Gate=list_2, Stream0=fk_configuration, Stream1=py3)
inverse_kinematics = Python3Script(
    compute=compute,
    robot=set.robot,
    plane=plane,
    start_configuration=filter,
    go_to_start_configuration=go_to_start_configuration,
    avoid_collisions=avoid_collisions)  # -> out, ik_configuration, t0cp
# ---------- inverse_kinematics: Python ----------
from __future__ import print_function
import logging
from scriptcontext import sticky as st

from compas.geometry import Frame
#from compas_ghpython.artists import Artist
from compas_rhino.conversions import frame_to_rhino

LOGGER = logging.getLogger('roslibpy')

#vizualize t0cf
if robot.attached_tool:
    t0cf = Frame(plane.Origin, plane.XAxis, plane.YAxis)
    t0cf = robot.from_tcf_to_t0cf([t0cf])[0]
    t0cp = frame_to_rhino(t0cf)
    print (t0cf)


if compute:
    if robot.attached_tool:
        tool_attached = True
    else:
        tool_attached = False

    robot.client = robot.ros_client
    if go_to_start_configuration:
        ik_configuration = start_configuration
    else:
        frame = Frame(plane.Origin, plane.XAxis, plane.YAxis)
        if tool_attached:
            tool_frame = robot.from_tcf_to_t0cf([frame])[0]
        else:
            tool_frame = frame

        ik_configuration = robot.inverse_kinematics(tool_frame,
                                                      start_configuration,
                                                      group=group,
                                                      options={
                                                        'avoid_collisions':avoid_collisions,
                                                        'return_full_configuration':True,
                                                      })        
    #group_configuration = robot.get_group_configuration(group, ik_configuration)
    #print (group_configuration)
    st["ik_configuration"] = ik_configuration

ik_configuration = st["ik_configuration"] 
print(ik_configuration)
# ---------- end inverse_kinematics ----------
py3_2 = Python3Script(planes=inverse_kinematics.t0cp, scale=Slider(0.2, range=0..1))  # -> P, V, C, W; inputs planes: list
# ---------- py3_2: Python ----------
from System.Drawing import Color
from compas.geometry import Frame
from compas_rhino.conversions import frame_to_rhino

red = Color.FromArgb(255, 0, 0)
green = Color.FromArgb(0, 255, 0)
blue = Color.FromArgb(0, 0, 255)

P = []
V = []
C = []

scale = float(scale)

for plane in planes:
    if not plane:
        continue
    P += [plane.Origin] * 3
    V.append(plane.XAxis * scale)
    V.append(plane.YAxis * scale)
    V.append(plane.ZAxis * scale)
    C += [red, green, blue]

W = 3
# ---------- end py3_2 ----------
out = Panel(inverse_kinematics.out)
vdisex = VectorDisplayEx(Point=py3_2.P, Vector=py3_2.V, Colour=py3_2.C, Width=py3_2.W)

list_3 = ValueList({"0 forward_kinematics": 0, "1 inverse_kinematics": 1}, selected="0 forward_kinematics")
ik_configuration = Data(inverse_kinematics.ik_configuration)
fk_configuration_2 = Data(forward_kinematics)
filter_2 = StreamFilter(Gate=list_3, Stream0=fk_configuration_2, Stream1=ik_configuration)

# ----
# Move Joints
tcp_speed = Slider(98, range=0..1000)
to_joints = Button()
movej_command = Python3Script(configuration=filter_2, speed=tcp_speed, move_to_joints=to_joints)  # -> out
# ---------- movej_command: Python ----------
import abb_fabrication_control as afc
import compas_rrc as rrc

if move_to_joints:
    afc.commands.move_to_joints(robot, configuration, speed=speed, zone=rrc.Zone.FINE)
# ---------- end movej_command ----------
data_recorder = DataRecorder(movej_command, DataLimit=-10, RecordData=True)
out_2 = Panel(data_recorder)

# ----
# Turn Only Extruder On/Off directly
max_speed = Slider(14000, range=5000..30000)
send = Button()

# ----
# EMERGENCY STOP
# EXTRUSION
value = BooleanToggle(False)
# Adjust speeds or turning on the extruder and mixer directly
send_2 = Button()

# ----
# Visualisation
# Robot Control
show_end_effector_frame = BooleanToggle(False)
show_base_frame = BooleanToggle(False)
show_collision = BooleanToggle(False)
show_frames = BooleanToggle(False)
show_visual = BooleanToggle(True)
show_acm = BooleanToggle(False)
robot_visualize = Python3Script(
    robot=set.robot,
    configuration=filter_2,
    show_visual=show_visual,
    show_collision=show_collision,
    show_frames=show_frames,
    show_base_frame=show_base_frame,
    show_end_effector_frame=show_end_effector_frame,
    show_acm=show_acm)  # -> visual, collision, attached_meshes, frames, base_frame, ee_frame
# ---------- robot_visualize: Python ----------
"""
Visualizes the robot.

COMPAS FAB v0.19.1
"""
from compas.geometry import Frame
from compas_rhino.conversions import frame_to_rhino_plane
from compas.geometry import Transformation


if robot:
    show_visual = True if show_visual is None else show_visual
    configuration = configuration or robot.zero_configuration()

    robot.update(configuration, visual=show_visual, collision=show_collision)
    compas_frames = robot.transformed_frames(configuration, group)
    print(len(compas_frames))

    if show_visual:
        visual = robot.draw_visual()

    if show_collision:
        collision = robot.draw_collision()

    if show_base_frame:
        base_compas_frame = compas_frames[0]
        base_frame = frame_to_rhino_plane(base_compas_frame)

    if show_end_effector_frame:
        ee_compas_frame = robot.forward_kinematics(
            configuration, group, options=dict(solver="model", link="tool0")
        )
        print(ee_compas_frame)
        print(robot.get_end_effector_frame())
        if robot.attached_tool:
            ee_compas_frame = robot.from_t0cf_to_tcf([ee_compas_frame])[0]
        ee_frame = frame_to_rhino_plane(ee_compas_frame)

    if show_frames:
        frames = []
        for compas_frame in compas_frames[1:]:
            frame = frame_to_rhino_plane(compas_frame)
            frames.append(frame)

    if show_acm:
        attached_meshes = []
        for acm in attached_collision_meshes:
            frame = robot.forward_kinematics(configuration, options=dict(solver='model', link_name=acm.link_name))
            T = Transformation.from_frame_to_frame(Frame.worldXY(), frame)
            mesh = acm.collision_mesh.mesh.transformed(T)
            attached_meshes.append(Artist(mesh).draw())

print(visual, collision, attached_meshes, frames, base_frame, ee_frame)
# ---------- end robot_visualize ----------
draw = Python3Script(frames=[robot_visualize.ee_frame, robot_visualize.frames, robot_visualize.base_frame], scale=Slider(0.2, range=0..1))  # -> P, V, C, W; inputs frames: list of Plane
# ---------- draw: Python ----------
from System.Drawing import Color
#from compas_ghpython.artists import FrameArtist
from compas.geometry import Frame
from compas_rhino.conversions import frame_to_rhino


red = Color.FromArgb(255, 0, 0)
green = Color.FromArgb(0, 255, 0)
blue = Color.FromArgb(0, 0, 255)

P = []
V = []
C = []

scale = float(scale)

for plane in frames:
    if not plane:
        continue
    P += [plane.Origin] * 3
    V.append(plane.XAxis * scale)
    V.append(plane.YAxis * scale)
    V.append(plane.ZAxis * scale)
    C += [red, green, blue]

W = 3
# ---------- end draw ----------
geo = Geometry([robot_visualize.visual, robot_visualize.collision, robot_visualize.attached_meshes])
preview = CustomPreview(Geometry=geo, Shader=ColourSwatch(SwatchColor=RGB(207, 157, 160)))
vdisex_2 = VectorDisplayEx(Point=draw.P, Vector=draw.V, Colour=draw.C, Width=draw.W)

value_2 = BooleanToggle(False)
print = Button()

# ----
# Turn Extrusion COMPLETELY On/Off directly
max_speed_2 = Slider(17000, range=0..51200)

max_speed_3 = Slider(9000, range=5000..10000)

# ----
# Turn Only CFS  On/Off directly
max_speed_4 = Slider(12400, range=5000..15000)
value_3 = BooleanToggle(False)
send_3 = Button()

# ----
# Hello robot!
py3_3 = Python3Script(robot=robot_2, send_text=print)  # -> out, a
# ---------- py3_3: Python ----------
from abb_fabrication_control.commands import print_text

if send_text and robot.abb_client:
    print_text(robot, 'Hello Robot!!!')
# ---------- end py3_3 ----------

get_frame = Button()
get_robtarget = Button()
get_joints = Button()

toggle = BooleanToggle(True)

# ----
# Move Cartesian
tcp_speed_2 = Slider(250, range=0..1000)
to_frame = Button()
target_plane = Plane(plane)
movel_command = Python3Script(configuration=filter_2, speed=tcp_speed_2, target_plane=target_plane, move_to_frame=toggle)  # -> out; inputs target_plane: Plane
# ---------- movel_command: Python ----------
import compas_rrc as rrc
import abb_fabrication_control as afc
from compas.geometry import Frame

#set tool in RobotStudio
if set_tool:
    if robot.attached_tool:
        tool_name = robot.attached_tool.name
        done = robot.abb_client.send(rrc.SetTool(tool_name))
        print(done)
    else:
        robot.abb_client.send(rrc.SetTool("tool0"))

if move_to_frame:
    #transform target plane into target frame
    target_frame = Frame(target_plane.Origin, target_plane.XAxis, target_plane.YAxis)
    print(target_plane)
    #send move to frame command
#    afc.commands.move_to_frame(robot, target_frame, speed=speed, zone=rrc.Zone.FINE, scalefactor=1000)
# ---------- end movel_command ----------
data_recorder_2 = DataRecorder(movel_command, DataLimit=-10, RecordData=True)
out_3 = Panel(data_recorder_2)

get_joints_2 = Python3Script(get_frame=toggle, get_robtarget=toggle, get_joints=get_joints)  # -> joint, current_plane
# ---------- get_joints_2: Python ----------
from scriptcontext import sticky as st
import abb_fabrication_control as afc
import os

#from compas_ghpython.artists import Artist

# store robot in component
guid = str(ghenv.Component.InstanceGuid)
current_frame_key = "current_frame_" + guid
current_robtarget_key = "current_robtarget_" + guid
current_configuration_key = "current_configuration_" + guid

if current_frame_key not in st:
    st[current_frame_key] = None

if current_robtarget_key not in st:
    st[current_robtarget_key] = None

if current_configuration_key not in st:
    st[current_configuration_key] = None


#get commands
if get_frame:
    current_frame = ffc.feedback.get_frame(robot, scalefactor=0.001)
    st[current_frame_key] = current_frame

if get_robtarget:
    current_robtarget = ffc.feedback.get_robtarget(robot, scalefactor=0.001)
    print(current_robtarget)
    st[current_robtarget_key] = current_robtarget


if get_joints:
    current_configuration = ffc.feedback.get_joints(robot)
    st[current_configuration_key] = current_configuration
    print(current_configuration)

# sticky
if st[current_frame_key]:
    current_frame = st[current_frame_key]
    current_plane = Artist(current_frame).draw()

if st[current_robtarget_key]:
    current_robtarget = st[current_robtarget_key]

if st[current_configuration_key]:
    current_configuration = st[current_configuration_key]
# ---------- end get_joints_2 ----------

# ----
# Get Robot Configurations
number_slider_2 = Slider(0.2, range=0..1)
data_recorder_3 = DataRecorder(get_joints_2.joint, DataLimit=-10, RecordData=True)
draw_2 = Python3Script(plane=get_joints_2.current_plane, scale=number_slider_2)  # -> P, V, C, W; inputs scale: String
# ---------- draw_2: Python ----------
from System.Drawing import Color
from compas.geometry import Frame
from compas_rhino.conversions import frame_to_rhino

red = Color.FromArgb(255, 0, 0)
green = Color.FromArgb(0, 255, 0)
blue = Color.FromArgb(0, 0, 255)

P = []
V = []
C = []

scale = float(scale)


if plane:
    P += [plane.Origin] * 3
    V.append(plane.XAxis * scale)
    V.append(plane.YAxis * scale)
    V.append(plane.ZAxis * scale)
    C += [red, green, blue]
    
    W = 3
# ---------- end draw_2 ----------
joint_values = Panel(data_recorder_3)
vdisex_3 = VectorDisplayEx(Point=draw_2.P, Vector=draw_2.V, Colour=draw_2.C, Width=draw_2.W)

close = Button()
connect = Button()

panel_3 = Panel(get_joints_2.joint)

# ----
# Move Cartesian
target_planes = Plane()
set_tool = Button()
cart = IronPython2Script()  # -> out, linear_axis_value
# ---------- cart: IronPython ----------
if configuration:
    linear_axis_value = (configuration.joint_values[0])
else:
    linear_axis_value = 0
# ---------- end cart ----------
tcp_speed_3 = Slider(30, range=0..250)
to_robtarget = Button()
to_frame_2 = Button()

# ----
# Robot Instructions
# Motion
# Hello robot!
robot_3 = Data(robot_2)
to_one_frame = Button()
print_2 = Button()
print_3 = IronPython2Script(robot=robot_3, send_text=print_2)  # -> out, a; inputs send_text: Boolean; same code as py3_3
get_frame_2 = Button()
send_tool = Button()

# ----
# Move Joints
target_configuration = Data()
to_joints_2 = Button()
tcp_speed_4 = Slider(30, range=0..250)
move_joints = IronPython2Script(robot=robot_3, configurations=target_configuration, speed=tcp_speed_4, send_move_to_joints=to_joints_2)  # -> out; inputs configurations: list
# ---------- move_joints: IronPython ----------
from abb_fabrication_control.commands import move_to_joints
import compas_rrc as rrc
scalefactor = 1000 # m to mm conversion for ABB robot controller

# move to joints
if send_move_to_joints and robot.abb_client:
    
    for i, configuration in enumerate(configurations):
        if i < len(configurations)-1:
            zone = rrc.Zone.Z200
        else:
            zone = rrc.Zone.FINE
        #print(zone)
        success = move_to_joints(robot, configuration, speed=speed, zone=zone, scalefactor=scalefactor, send_and_wait=False)
        #print("SENDING")
# ---------- end move_joints ----------

move_linear = IronPython2Script(
    robot=robot_3,
    target_planes=target_planes,
    linear_axis_value=cart.linear_axis_value,
    speed=tcp_speed_3,
    send_move_to_one_frame=to_one_frame,
    send_set_tool_attached=set_tool,
    send_move_to_frame=to_frame_2,
    send_move_to_robtarget=to_robtarget)  # -> out; inputs target_planes: list, linear_axis_value: Double, send_move_to_one_frame: Boolean, send_set_tool_attached: Boolean
# ---------- move_linear: IronPython ----------
from abb_fabrication_control.commands import set_tool, set_tool_attached, move_to_frame, move_to_robtarget
from compas_rhino.conversions import plane_to_compas_frame
import compas_rrc as rrc
target_frames = [plane_to_compas_frame(target_plane) for target_plane in target_planes] # convert target plane (Rhino plane) into target frame (compas frame)
scalefactor = 1000 # m to mm conversion for ABB robot controller
print(scalefactor)

if robot:
    print(robot.abb_client)

# set tool in RobotStudio
if send_set_tool_attached and robot.abb_client:
    success = set_tool_attached(robot, send_and_wait=False)

# move linear to frame
if send_move_to_frame and robot.abb_client:

    for i, target_frame in enumerate(target_frames):
        if i < len(target_frames)-1:
            zone = rrc.Zone.Z1
        else:
            zone = rrc.Zone.Z1

        success = move_to_frame(robot, target_frame, speed=speed, zone=zone, scalefactor=scalefactor, send_and_wait=False)

# move linear to frame
if send_move_to_one_frame and robot.abb_client:
    zone = rrc.Zone.Z1
    success = move_to_frame(robot, target_frames[0], speed=speed, zone=zone, scalefactor=scalefactor, send_and_wait=False)
# move linear to robtarget
if send_move_to_robtarget and robot.abb_client :
    
    for i, target_frame in enumerate(target_frames):
        if i < len(target_frames)-1:
            zone = rrc.Zone.Z1
        else:
            zone = rrc.Zone.Z1

        success = move_to_robtarget(robot, target_frame, linear_axis_value, speed=speed, zone=zone, scalefactor=scalefactor, send_and_wait=False)
# ---------- end move_linear ----------

py3_4 = Python3Script(robot=robot_3, send_text=print_2)  # -> out, a; same code as py3_3

# ----
# Digital Output
extruder_start = Button()
open_gripper = Button()
close_gripper = Button()
# Position Feedback
extruder_stop = Button()
set_do = Button()
list_4 = ValueList({"grippper": 'Ausgang_100_0'}, selected="grippper")
list_5 = ValueList({"0", "1"}, selected="1")
set_digital_output = IronPython2Script(
    robot=robot_3,
    digital_out_name=list_4,
    digital_out_state=list_5,
    send_set_digital_out=set_do,
    send_gripper_open=open_gripper,
    send_gripper_close=close_gripper,
    send_extruder_start=extruder_start,
    send_extruder_stop=extruder_stop)  # -> out; inputs digital_out_name: String
# ---------- set_digital_output: IronPython ----------
from abb_fabrication_control.commands import set_digital_out, open_gripper, close_gripper

if send_set_digital_out and robot.abb_client:
    set_digital_out(robot, digital_out_name, output_state=digital_out_state, send_and_wait=False)

if send_gripper_open and robot.abb_client:
    open_gripper(robot)

if send_gripper_close and robot.abb_client:
    close_gripper(robot)

if send_extruder_start and robot.abb_client:
    pass #TODO

if send_extruder_stop and robot.abb_client:
    pass #TODO
# ---------- end set_digital_output ----------

get_robtarget_2 = Button()
get_joints_3 = Button()
feedback = IronPython2Script(
    robot=robot_3,
    send_set_tool_attached=send_tool,
    send_get_frame=get_frame_2,
    send_get_robtarget=get_robtarget_2,
    send_get_joints=get_joints_3)  # -> out, current_plane_out, current_axis_value, current_configuration
# ---------- feedback: IronPython ----------
from scriptcontext import sticky as st
from abb_fabrication_control.commands import set_tool,set_tool_attached, move_to_frame, move_to_robtarget, get_frame, get_robtarget, get_joints
from compas_rhino.conversions import frame_to_rhino


# set tool in RobotStudio
if send_set_tool_attached and robot.abb_client:
    success = set_tool_attached(robot, send_and_wait=False)
print(set_tool_attached)
if "current_frame_key" not in st:
    st["current_frame_key"] = None

if "current_robtarget_key" not in st:
    st["current_robtarget_key"] = None

if "current_configuration_key" not in st:
    st["current_configuration_key"] = None


# get values from ABB robot controller
if send_get_frame:

    current_frame = get_frame(robot, scalefactor=0.001)
    st["current_frame_key"] = current_frame
print(current_frame)
if send_get_robtarget:
    current_robtarget = get_robtarget(robot, scalefactor=0.001)
    st["current_robtarget_key"] = current_robtarget


if send_get_joints:
    current_configuration = get_joints(robot, scalefactor=0.001)
    st["current_configuration_key"] = current_configuration



# sticky
#current_frame = st["current_frame_key"]
#if current_frame:
    #current_plane = frame_to_rhino(current_frame)

#else:
    #current_plane = []

current_plane_out = frame_to_rhino(current_frame)
#print(type(current_plane))


current_robtarget = st["current_robtarget_key"]
if current_robtarget:
    current_frame, current_axis_value = current_robtarget
    current_plane = frame_to_rhino(current_frame)
else: 
    current_plane, current_axis_value = [], 0

current_configuration = st["current_configuration_key"]
if st["current_configuration_key"]:
    current_configuration = st["current_configuration_key"]
else:
    if robot:
        current_configuration = robot.model.zero_configuration()
    else:
        current_configuration = None
# ---------- end feedback ----------
draw_3 = Python3Script(planes=feedback.current_plane_out, scale=Slider(0.2, range=0..1))  # -> out, P, V, C, W; inputs planes: list of Plane
# ---------- draw_3: Python ----------
from System.Drawing import Color


print(planes)

red = Color.FromArgb(255, 0, 0)
green = Color.FromArgb(0, 255, 0)
blue = Color.FromArgb(0, 0, 255)

P = []
V = []
C = []

scale = float(scale)

for plane in planes:
    if not plane:
        continue
    P += [plane.Origin] * 3
    V.append(plane.XAxis * scale)
    V.append(plane.YAxis * scale)
    V.append(plane.ZAxis * scale)
    C += [red, green, blue]

W = 3
# ---------- end draw_3 ----------
vdisex_4 = VectorDisplayEx(Point=draw_3.P, Vector=draw_3.V, Colour=draw_3.C, Width=draw_3.W)

panel_4 = Panel(feedback.current_plane_out)
pln = Plane(feedback.current_plane_out)

# ----
# Extrusion
# Extrusion Clients
ext_ip = ValueList({"192.168.10.10", "192.168.10.20", "192.168.10.11", "192.168.10.12", "127.0.0.1", "192.168.10.111", "192.168.0.220", "192.168.0.30", "192.168.10.50", "0.0.0.0", "192.168.125.22"}, selected="192.168.125.22")
cfs_ip = ValueList({"192.168.125.22", "192.168.125.23", "192.168.125.24"}, selected="192.168.125.23")
ext_port = ValueList({"50003", "50004"}, selected="50004")
close_2 = Button()

py3_5 = Python3Script(ip=ext_ip, port=ext_port, cfs_ip=cfs_ip, connect=Toggle(True), close=close_2)  # -> out, ec_client, cfs_client, connected, cfs_connected
# ---------- py3_5: Python ----------
from scriptcontext import sticky as st
from compas_fab.backends import RosClient
from extruder_control_wasp.extruderclient import ExtruderClient


if 'ec_client' not in st:
    st['ec_client'] = None    
    st['connected'] = False

if 'cfs_client' not in st:
    st['cfs_client'] = None    
    st['cfs_connected'] = False


ec_client = ExtruderClient(ip, port)
cfs_client = ExtruderClient(cfs_ip, port)
if close:
    ec_client.close()
    cfs_client.close()
    st['ec_client'] = None  
    st['cfs_client'] = None 
    st['connected'] = False
    st['cfs_connected'] = False

if connect:
    
    try:
        ec_client.connect()
        cfs_client.connect()
    except:
        print('Cannot connect to Extr Client')
    
    
    st['connected'] = ec_client.connected if ec_client else False
    st['cfs_connected'] = cfs_client.connected if cfs_client else False

    if st['connected']:
        st['ec_client'] = ec_client

    if st['cfs_connected']:
        st['cfs_client'] = cfs_client

connected = st['connected']
ec_client = st['ec_client']
cfs_connected = st['cfs_connected']
cfs_client = st['cfs_client']


print('Extr Client: ', ec_client)
print('connected: ', connected)
print('CFS Client: ', cfs_client)
print('cfs_connected: ', cfs_connected)
# ---------- end py3_5 ----------
py3_6 = Python3Script(ec_client=py3_5.ec_client, motor_state=value_2, max_speed=max_speed, speed=max_speed, send=send)  # -> out
# ---------- py3_6: Python ----------
import time
from scriptcontext import sticky as st
from extruder_control_wasp.extruderclient import ExtruderClient
ec_client = st['ec_client']
wait_for_response = False


if send:
    ec_client.send_motordata(motor_state, max_speed , speed , wait_for_response)
# ---------- end py3_6 ----------
py3_7 = Python3Script(cfs_client=py3_5.cfs_client, motor_state=value_3, max_speed=max_speed_4, speed=max_speed_4, send=send_3)  # -> out
# ---------- py3_7: Python ----------
import time
from scriptcontext import sticky as st
from extruder_control_wasp.extruderclient import ExtruderClient
ec_client = st['ec_client']
cfs_client = st['cfs_client']
wait_for_response = False


cfs_speed = float(max_speed)
if send:

    #cfs.send_motordata(motor_state, cfs_speed1, cfs_speed2, wait_for_response)
    cfs_client.send_motordata(motor_state, cfs_speed , cfs_speed , wait_for_response)
# ---------- end py3_7 ----------
py3_8 = Python3Script(
    ec_client=py3_5.ec_client,
    cfs_client=py3_5.cfs_client,
    motor_state=value,
    max_speed=max_speed_3,
    speed=max_speed_2,
    send=send_2)  # -> out
# ---------- py3_8: Python ----------
import time
from scriptcontext import sticky as st
from extruder_control_wasp.extruderclient import ExtruderClient
ec_client = st['ec_client']
cfs_client = st['cfs_client']
wait_for_response = False


cfs_speed = max_speed
if send:

    #cfs.send_motordata(motor_state, cfs_speed1, cfs_speed2, wait_for_response)
    ec_client.send_motordata(motor_state, speed, speed, wait_for_response)
    cfs_client.send_motordata(motor_state, cfs_speed , cfs_speed , wait_for_response)
# ---------- end py3_8 ----------

cfs_connected = Panel(py3_5.cfs_connected)
ec_connected = Panel(py3_5.connected)
cfs_client = Data(py3_5.cfs_client)
ec_client = Data(py3_5.ec_client)

# ----
# Turn Mixer On/Off
max_speed_5 = Slider(22000, range=17000..30000)
value_4 = BooleanToggle(False)
send_4 = Button()

# ----
# Mixer Clients
mixer_ip = ValueList({"192.168.125.22", "192.168.125.23", "192.168.125.24"}, selected="192.168.125.24")
mixer_port = ValueList({"50003", "50004"}, selected="50004")

py3_9 = Python3Script(ip=mixer_ip, port=mixer_port, mixer_ip=mixer_ip, connect=connect, close=close)  # -> out, mixer_client, mixer_connected
# ---------- py3_9: Python ----------
from scriptcontext import sticky as st
from compas_fab.backends import RosClient
from extruder_control_wasp.extruderclient import ExtruderClient


if 'mixer_client' not in st:
    st['mixer_client'] = None    
    st['mixer_connected'] = False



mixer_client = ExtruderClient(ip, port)

if close:
    mixer_client.close()  
    st['mixer_client'] = None 
    st['mixer_connected'] = False

if connect:
    
    try:
        mixer_client.connect()
    except:
        print('Cannot connect to Mixer Client')
    
    
    st['mixer_connected'] = mixer_client.connected if mixer_client else False

    if st['mixer_connected']:
        st['mixer_client'] = mixer_client


mixer_connected = st['mixer_connected']
mixer_client = st['mixer_client']


print('Mixer Client: ', mixer_client)
print('mixer_connected: ', mixer_connected)
# ---------- end py3_9 ----------

mixer_client = Data(py3_9.mixer_client)
mixer_connected = Panel(py3_9.mixer_connected)

py3_10 = Python3Script(mixer_client=mixer_client, motor_state=value_4, max_speed=max_speed_5, speed=max_speed_5, send=send_4)  # -> out
# ---------- py3_10: Python ----------
import time
from scriptcontext import sticky as st
from extruder_control_wasp.extruderclient import ExtruderClient
mixer_client = st['mixer_client']

wait_for_response = False



if send:

   
    mixer_client.send_motordata(motor_state, max_speed , speed , wait_for_response)
# ---------- end py3_10 ----------

# ==== cluster Tools

# ---- group: Wasp extruder
# wasp extruder
geo = Geometry([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])
mesh = Mesh(geo)
show = BooleanToggle(True)
mjoin = MeshJoin(Meshes=mesh)
yaxis_line = Curve(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)
xaxis_line = Curve(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)
tool = Python3Script(name="t_wasp_extruder", visual_mesh=mjoin, xline=xaxis_line, yline=yaxis_line, show=show)  # -> out, tool, tool_plane, tool_geometry, tool_frame_rs; inputs visual_mesh: Mesh, xline: Line, yline: Line
# ---------- tool: Python ----------
from __future__ import print_function

import Rhino.Geometry as rg
import os, math
from compas.geometry import Frame, Rotation
from compas.datastructures import Mesh
from compas_fab.robots import Tool


from compas_rhino.conversions import plane_to_compas_frame, mesh_to_compas, mesh_to_rhino

xaxis = xline
yaxis = yline

if xaxis.From.DistanceTo(yaxis.From) < 0.01:
    origin = xaxis.From
    xaxis = xaxis.Direction
    yaxis = yaxis.Direction
elif xaxis.To.DistanceTo(yaxis.To) < 0.01:
    origin = xaxis.To
    xaxis = -xaxis.Direction
    yaxis = -yaxis.Direction
elif xaxis.From.DistanceTo(yaxis.To) < 0.01:
    origin = xaxis.From
    xaxis = xaxis.Direction
    yaxis = -yaxis.Direction
elif xaxis.To.DistanceTo(yaxis.From) < 0.01:
    origin = xaxis.To
    xaxis = -xaxis.Direction
    yaxis = yaxis.Direction

xaxis.Unitize()
yaxis.Unitize()

plane = rg.Plane(origin, xaxis, yaxis)

frame = plane_to_compas_frame(plane) # convert to copmas frame
c_visual_mesh = mesh_to_compas(visual_mesh) # convert to compas mesh

# create Tool
# tool = Tool(c_visual_mesh, frame, name=name, connected_to="tool0")
tool = Tool(c_visual_mesh, frame, name=name)

# create values for Robot Studio tool (in mm and quaternion format)
tool_frame_rs = [[entry*1000 for entry in list(frame.point)], list(frame.quaternion)]

# round values
tool_frame_rs = str([[round(v, 5) for v in tool_frame_rs[0]], [round(v, 5) for v in tool_frame_rs[1]]])


if show:
    #print(("The tool {} will be connected to {}").format(tool.name, tool.connected_to))
    tool_plane = plane
    tool_geometry = mesh_to_rhino(c_visual_mesh)
else: 
    tool_plane = []
    tool_geometry = []


print(tool_frame_rs)
# ---------- end tool ----------

# ---- group: measurement tool
geo_2 = Geometry(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)
mesh_2 = Mesh(geo_2)
mjoin_2 = MeshJoin(Meshes=mesh_2)
xaxis_line_2 = Curve(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)
yaxis_line_2 = Curve(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)
tool_2 = Python3Script(rhmesh=mjoin_2, xline=xaxis_line_2, yline=yaxis_line_2)  # -> tool; inputs rhmesh: Mesh, xline: Line, yline: Line
# ---------- tool_2: Python ----------
import Rhino.Geometry as rg
import os, math
from compas.geometry import Frame, Rotation
from compas.datastructures import Mesh
from compas_rhino.conversions import mesh_to_compas
#from compas_ghpython.scene import MeshObject
from compas_fab.robots import Tool
#from compas_rhino.scene import RhinoMeshObject

#xaxis = rg.Line(xline.From, xline.To)
#yaxis = rg.Line(yline.PointAtStart, yline.PointAtEnd)
xaxis = xline
yaxis = yline

if xaxis.From.DistanceTo(yaxis.From) < 0.01:
    origin = xaxis.From
    xaxis = xaxis.Direction
    yaxis = yaxis.Direction
elif xaxis.To.DistanceTo(yaxis.To) < 0.01:
    origin = xaxis.To
    xaxis = -xaxis.Direction
    yaxis = -yaxis.Direction
elif xaxis.From.DistanceTo(yaxis.To) < 0.01:
    origin = xaxis.From
    xaxis = xaxis.Direction
    yaxis = -yaxis.Direction
elif xaxis.To.DistanceTo(yaxis.From) < 0.01:
    origin = xaxis.To
    xaxis = -xaxis.Direction
    yaxis = yaxis.Direction

xaxis.Unitize()
yaxis.Unitize()

ee_frame = Frame(origin, xaxis, yaxis)
ee_mesh = mesh_to_compas(rhmesh)

tool = Tool(ee_mesh, ee_frame)
# ---------- end tool_2 ----------

# ----
G = ClusterInput()
mesh_3 = Mesh(tool.tool_geometry)
filter = StreamFilter(Gate=G, Stream0=tool_2, Stream1=tool.tool)
preview = CustomPreview(Geometry=mesh_3, Shader=ColourSwatch(SwatchColor=RGBA(207, 157, 160, 157)))
values_for_abb_robot_studio = Panel(tool.tool)
s_1 = ClusterOutput(filter)
draw = Python3Script(planes=tool.tool_plane, scale=Slider(0.2, range=0..1))  # -> out, P, V, C, W; inputs planes: list of Plane
# ---------- draw: Python ----------
from System.Drawing import Color

red = Color.FromArgb(255, 0, 0)
green = Color.FromArgb(0, 255, 0)
blue = Color.FromArgb(0, 0, 255)

P = []
V = []
C = []

scale = float(scale)

for plane in planes:
    if not plane:
        continue
    P += [plane.Origin] * 3
    V.append(plane.XAxis * scale)
    V.append(plane.YAxis * scale)
    V.append(plane.ZAxis * scale)
    C += [red, green, blue]

W = 3
# ---------- end draw ----------
vdisex = VectorDisplayEx(Point=draw.P, Vector=draw.V, Colour=draw.C, Width=draw.W)
