# Grasshopper definition 04_crb15000_moveit_simulation_plan_motion_py3.ghx (Grasshopper 1.0.8)

reload = Button()
path = Python3Script()  # -> HERE, DATA, ROBOT_DESCRIPTION
# ---------- path: Python ----------
import os

HERE = os.path.dirname(ghdoc.Path)
DATA = os.path.abspath(os.path.join(HERE, "..", "data"))
ROBOT_DESCRIPTION = os.path.abspath(os.path.join(DATA, "robot_description"))

print(HERE)
print(DATA)
print(ROBOT_DESCRIPTION)
# ---------- end path ----------
py = Python3Script(reload=reload)
# ---------- py: Python ----------
from compas_ghpython import unload_modules

if reload:
    unload_modules("fabtory_fabrication_control")
    unload_modules("compas_rrc")
    unload_modules("crb15000_control")
    unload_modules("abb_fabrication_control")
# ---------- end py ----------

# ----
# ROS client
ip = ValueList({"127.0.0.1", "192.168.0.4"}, selected="127.0.0.1")
robot_port = ValueList({"9090", "30101"}, selected="9090")
ros = Python3Script(ip=ip, port=robot_port, connect=Toggle(True))  # -> ros_client, is_connected
# ---------- ros: Python ----------
from ghpythonlib.componentbase import executingcomponent as component
from scriptcontext import sticky as st

from compas_fab.backends import RosClient
#from compas_fab.ghpython.components import create_id



ros_client = None

ip = ip or '127.0.0.1'
port = port or 9090

key = 'ros_client'
ros_client = st.get(key, None)

if ros_client:
    st[key].close()
if connect:
    st[key] = RosClient(ip, port)
    st[key].run(5)

ros_client = st.get(key, None)
is_connected = ros_client.is_connected if ros_client else False
print(ros_client, is_connected)
# ---------- end ros ----------
is_connected = Panel(ros.is_connected)

brep = Brep(<brep referenced from the Rhino model>)

# ----
# Load robot from ROS
load = Button()
robot = Python3Script(ros_client=ros.ros_client, load=load)  # -> out, robot; inputs prefix: String
# ---------- robot: Python ----------
"""
Load robot directly from ROS.

COMPAS FAB v0.27.0
"""
import Rhino
import scriptcontext
from scriptcontext import sticky as st

scriptcontext.doc = Rhino.RhinoDoc.ActiveDoc

from compas_robots import RobotModel
from compas_robots.ghpython.scene import RobotModelObject
from compas.scene import SceneObject
import compas_robots.ghpython

scriptcontext.doc = ghdoc

key = 'robot'
print(key)
if ros_client and ros_client.is_connected and load:
    # Load URDF from ROS
    robot = ros_client.load_robot(
            load_geometry=True, 
            urdf_param_name= '{}/robot_description'.format(prefix),
            srdf_param_name= '{}/robot_description_semantic'.format(prefix))
    robot.scene_object = SceneObject(item=robot.model)
    # mobile_robot = MobileRobot(robot.model, robot.scene_object, robot.semantics, client=None)
    st[key] = robot


robot = st.get(key, None)
if robot:  # client sometimes need to be restarted, without needing to reload geometry
    robot.client = ros_client
# ---------- end robot ----------

panel = Panel("""tool0
flange
link_6""")

robot_2 = Data(robot.robot)
info = Python3Script(robot=robot_2)  # -> out, main_group_name
# ---------- info: Python ----------
if robot:
    robot.info()
    main_group_name = robot.main_group_name
# ---------- end info ----------
panel_2 = Panel(info.out)

# ----
# Tool
panel_3 = Panel("Attach a custom tool")
list = ValueList({"measurement_tool": 0, "wasp_extruder": 1}, selected="measurement_tool")
remove = Button()
add = Button()
tools = Tools(G=list)
attach_remove = Python3Script(robot=robot_2, tool=tools, attach=add, remove=remove)  # -> out, bang
# ---------- attach_remove: Python ----------
for acm in tool.attached_collision_meshes:
    acm.touch_links=["tool0", "flange", "link_6"]
    print(acm.touch_links)
if attach:
    robot.attach_tool(tool, touch_links=["tool0", "flange", "link_6"])
if remove:
    robot.detach_tool()
# ---------- end attach_remove ----------

# ----
# Planning scene
scene = Python3Script(robot=robot_2, clear=Button())  # -> scene
# ---------- scene: Python ----------
"""
Create a planning scene.

COMPAS FAB v0.28.0
"""

from ghpythonlib.componentbase import executingcomponent as component
from scriptcontext import sticky as st

from compas_fab.robots import PlanningScene


key = "planning_scene"
if robot:
    st[key] = PlanningScene(robot)

if clear:
    st[key] = PlanningScene(robot)

scene = st[key]
# ---------- end scene ----------

# ----
# Attach collision mesh to scene
append = Button()
remove_2 = Button()
add_2 = Button()
mesh_object = Mesh(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)
mesh_table = Mesh(brep)
collision_mesh = Python3Script(scene=scene, mesh=mesh_table, identifier="box", add=add_2, append=append, remove=remove_2)  # -> collision_meshes, bang; inputs mesh: Mesh, identifier: String
# ---------- collision_mesh: Python ----------
"""
Add or remove a collision mesh from the planning scene.
"""

from compas_rhino.conversions import mesh_to_compas
from compas_fab.robots import CollisionMesh

from scriptcontext import sticky as st 

key = "collision_meshes"
if key not in st:
    st[key] = {}

ok = False
Message = ""

if (add and append) or (append and remove) or (add and remove):
    Message = "Use only one operation at a time\n(add, append or remove)"
    raise Exception(Message)

if scene and mesh and identifier:
    compas_mesh = mesh_to_compas(mesh)
    collision_mesh = CollisionMesh(compas_mesh, identifier)
    if add:
        scene.add_collision_mesh(collision_mesh)
        st[key].update({identifier:collision_mesh})
        Message = "Added"
        ok = True
    if append:
        scene.append_collision_mesh(collision_mesh)
        st[key].update({identifier:collision_mesh})
        Message = "Appended"
        ok = True
    if remove:
        scene.remove_collision_mesh(identifier)
        st[key].pop(identifier)
        Message = "Removed"
        ok = True

collision_meshes = st[key]
# ---------- end collision_mesh ----------
panel_4 = Panel(collision_mesh.collision_meshes)

# ----
# Attach collision mesh to robot
panel_5 = Panel("attached_brick")
remove_3 = Button()
add_3 = Button()
mesh = Mesh(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)
attached_collision_mesh = Python3Script(scene=scene, mesh=mesh, identifier=panel_5, link_name="tool0", touch_links=panel, add=add_3, remove=remove_3)  # -> out, attached_collision_mesh, bang; inputs mesh: Mesh, touch_links: list
# ---------- attached_collision_mesh: Python ----------
"""
Add an attached collision mesh to the robot.

COMPAS FAB v0.28.0
"""

from compas_rhino.conversions import mesh_to_compas
from ghpythonlib.componentbase import executingcomponent as component

from compas_fab.robots import AttachedCollisionMesh
from compas_fab.robots import CollisionMesh

from compas_ghpython import create_id

from scriptcontext import sticky as st

key = "attached_collision_meshes"
if key not in st:
    st[key] = {}
if scene and mesh and identifier and link_name:
    compas_mesh = mesh_to_compas(mesh)
    collision_mesh = CollisionMesh(compas_mesh, identifier)
    acm = AttachedCollisionMesh(collision_mesh, link_name, touch_links)
    if add:
        scene.add_attached_collision_mesh(acm)
        st[key].update({identifier:acm})
    if remove:
        scene.remove_attached_collision_mesh(identifier)
        scene.remove_collision_mesh(identifier)
        st[key].pop(identifier)

attached_collision_mesh = list(st[key].values())
# ---------- end attached_collision_mesh ----------
panel_6 = Panel(attached_collision_mesh.attached_collision_mesh)

# ----
# Robot Model
abb_client = Python3Script(ros_client=ros.ros_client, connect=Toggle(True))  # -> out, abb_client
# ---------- abb_client: Python ----------
import compas_rrc as rrc

if ros_client:
    if ros_client.is_connected and connect: 
        # Create ABB Client
        abb_client = rrc.AbbClient(ros_client, '/rob1')
# ---------- end abb_client ----------
set = Python3Script(robot=robot_2, ros_client=ros.ros_client, abb_client=abb_client.abb_client)  # -> out, robot, main_group_name
# ---------- set: Python ----------
if robot and ros_client and abb_client:
    robot.ros_client = ros_client
    robot.abb_client = abb_client

    semantics = robot.semantics
    main_group_name = robot.semantics.main_group_name
    
print(robot.model.get_link_by_name("tool0"))
# ---------- end set ----------

# ----
# Configuration
# Forward kinematics
number_slider = Slider(0, range=-180..180)

jp = Python3Script()  # -> configuration_values
# ---------- jp: Python ----------
import math
joint_values = [-3.136, -0.328, -1.218, 3.129, 0.852, 0.008]
#joint_values = [math.degrees(j) for j in joint_values]
#joint_positions = [0] * 6

joint_values = [0,0,0,0,0,0]

configuration_values = joint_values
# ---------- end jp ----------
plane = Plane(Plane(origin=(0.4290372708, 1.01027229, 0), x=(-0.9410848618, -0.3381704939, 0), y=(-0.3381704939, 0.9410848618, 0)))
forward_kinematics = Python3Script(
    robot=set.robot,
    reset_configuration=Button(),
    configuration_values=jp,
    a_a1=number_slider,
    a_a2=Slider(0, range=-90..150),
    a_a3=Slider(0, range=-180..180),
    a_a4=Slider(0, range=-400..400),
    a_a5=Slider(0, range=-125..120),
    a_a6=Slider(0, range=-400..400))  # -> full_configuration; inputs configuration_values: list
# ---------- forward_kinematics: Python ----------
import math
import Grasshopper
import copy
from compas_robots.model import Joint
from compas_robots import Configuration

if reset_configuration:
    j = 0
    for i in range(ghenv.Component.Params.Input.Count):
        nslider = ghenv.Component.Params.Input[i].Sources[0]
        if nslider.GetType() == Grasshopper.Kernel.Special.GH_NumberSlider:
            nslider.TrySetSliderValue(configuration_values[j])
            j += 1


if robot:
    joint_positions = [a_a1, a_a2, a_a3, a_a4, a_a5, a_a6]
    print(joint_positions)
    joint_positions_degrees = copy.deepcopy(joint_positions)
    joint_types = robot.get_configurable_joint_types()
    print(joint_types)
    for i, joint_type in enumerate(joint_types):
        if joint_type == Joint.REVOLUTE:
            joint_positions[i] = math.radians(joint_positions[i])
        if joint_type == Joint.PRISMATIC:
            joint_positions[i] = joint_positions[i]
    full_configuration = Configuration(joint_positions, joint_types)
    print(full_configuration)
# ---------- end forward_kinematics ----------

# ----
# Inverse kinematics
py3 = Python3Script()  # -> configuration
# ---------- py3: Python ----------
from compas_robots import Configuration

if robot:
    types = robot.get_configurable_joint_types()
    values = [0] * len(types)
    configuration = Configuration(values, types)
    print(configuration)
    print(robot.get_configurable_joint_names())
# ---------- end py3 ----------
fk_configuration = Data(forward_kinematics)
go_to_start_configuration = BooleanToggle(False)
list_2 = ValueList({"0", "1"}, selected="0")
avoid_collisions = BooleanToggle(False)
compute = BooleanToggle(True)
filter = StreamFilter(Gate=list_2, Stream0=fk_configuration, Stream1=py3)
inverse_kinematics = Python3Script(
    compute=compute,
    robot=set.robot,
    plane=plane,
    start_configuration=filter,
    go_to_start_configuration=go_to_start_configuration,
    avoid_collisions=avoid_collisions)  # -> out, ik_configuration, t0cp
# ---------- inverse_kinematics: Python ----------
from __future__ import print_function
import logging
from scriptcontext import sticky as st

from compas.geometry import Frame
#from compas_ghpython.artists import Artist
from compas_rhino.conversions import frame_to_rhino

LOGGER = logging.getLogger('roslibpy')

#vizualize t0cf
if robot.attached_tool:
    t0cf = Frame(plane.Origin, plane.XAxis, plane.YAxis)
    t0cf = robot.from_tcf_to_t0cf([t0cf])[0]
    t0cp = frame_to_rhino(t0cf)
    print (t0cf)


if compute:
    if robot.attached_tool:
        tool_attached = True
    else:
        tool_attached = False

    robot.client = robot.ros_client
    if go_to_start_configuration:
        ik_configuration = start_configuration
    else:
        frame = Frame(plane.Origin, plane.XAxis, plane.YAxis)
        # if tool_attached:
        #     tool_frame = robot.from_tcf_to_t0cf([frame])[0]
        # else:
        tool_frame = frame

        ik_configuration = robot.inverse_kinematics(tool_frame,
                                                      start_configuration,
                                                      group=group,
                                                      options={
                                                        'avoid_collisions':avoid_collisions,
                                                        'return_full_configuration':True,
                                                      })        
    #group_configuration = robot.get_group_configuration(group, ik_configuration)
    #print (group_configuration)
    st["ik_configuration"] = ik_configuration

ik_configuration = st["ik_configuration"] 
print(ik_configuration)
# ---------- end inverse_kinematics ----------
py3_2 = Python3Script(planes=inverse_kinematics.t0cp, scale=Slider(0.2, range=0..1))  # -> P, V, C, W; inputs planes: list
# ---------- py3_2: Python ----------
from System.Drawing import Color
from compas.geometry import Frame
from compas_rhino.conversions import frame_to_rhino

red = Color.FromArgb(255, 0, 0)
green = Color.FromArgb(0, 255, 0)
blue = Color.FromArgb(0, 0, 255)

P = []
V = []
C = []

scale = float(scale)

for plane in planes:
    if not plane:
        continue
    P += [plane.Origin] * 3
    V.append(plane.XAxis * scale)
    V.append(plane.YAxis * scale)
    V.append(plane.ZAxis * scale)
    C += [red, green, blue]

W = 3
# ---------- end py3_2 ----------
out = Panel(inverse_kinematics.out)
vdisex = VectorDisplayEx(Point=py3_2.P, Vector=py3_2.V, Colour=py3_2.C, Width=py3_2.W)

fk_configuration_2 = Data(forward_kinematics)
list_3 = ValueList({"0", "1"}, selected="1")
filter_2 = StreamFilter(Gate=list_3, Stream0=fk_configuration_2, Stream1=inverse_kinematics.ik_configuration)

# ----
# Plan motion
plane_2 = Plane(Plane(origin=(0.9373701784, -0.2091342998, 0.4795403412), x=(-0.7236318944, -0.6901861209, 0), y=(-0.6846624067, 0.7178405061, 0.1262632037)))
constraints_from_plane = Python3Script(robot=robot_2, plane=plane_2, group=set.main_group_name)  # -> goal_constraints
# ---------- constraints_from_plane: Python ----------
"""
Create a position and an orientation constraint from a plane calculated for the group's end-effector link.

COMPAS FAB v1.0.2
"""

import math

from compas_rhino.conversions import plane_to_compas_frame


goal_constraints = None
if robot and plane:
    tolerance_position = tolerance_position or 0.001
    tolerance_xaxis = tolerance_xaxis or 1.0
    tolerance_yaxis = tolerance_yaxis or 1.0
    tolerance_zaxis = tolerance_zaxis or 1.0

    frame = plane_to_compas_frame(plane)
    tolerances_axes = [
        math.radians(tolerance_xaxis),
        math.radians(tolerance_yaxis),
        math.radians(tolerance_zaxis),
    ]
    goal_constraints = [robot.constraints_from_frame(frame, tolerance_position, tolerances_axes, group)]
# ---------- end constraints_from_plane ----------
compute_2 = Button()
plan_motion = Python3Script(
    robot=robot_2,
    goal_constraints=constraints_from_plane,
    start_configuration=filter_2,
    group=set.main_group_name,
    attached_collision_meshes=attached_collision_mesh.attached_collision_mesh,
    compute=compute_2)  # -> out, trajectory; inputs attached_collision_meshes: list
# ---------- plan_motion: Python ----------
"""
Calculate a motion path.

COMPAS FAB v1.0.2
"""

# from ghpythonlib.componentbase import executingcomponent as component
from scriptcontext import sticky as st
from compas_rhino.conversions import mesh_to_compas

key = "trajectory"

if compute: 
    path_constraints = list(path_constraints) if path_constraints else None
    attached_collision_meshes = list(attached_collision_meshes) if attached_collision_meshes else None
    planner_id = str(planner_id) if planner_id else "RRTConnect"
    print(
        robot,
        robot.ros_client,
        robot.ros_client.is_connected,
        start_configuration,
        goal_constraints,
        compute,
    )
    if (
        robot
        and robot.ros_client
        and robot.ros_client.is_connected
        and start_configuration
        and goal_constraints
        and compute
    ):
        st[key] = robot.plan_motion(
            goal_constraints,
            start_configuration=start_configuration,
            group=group,
            options=dict(
                attached_collision_meshes=attached_collision_meshes,
                path_constraints=path_constraints,
                planner_id=planner_id,
            ),
        )

trajectory = st.get(key, None)
# ---------- end plan_motion ----------
trajectory_visualize = Python3Script(robot=robot_2, group=set.main_group_name, trajectory=plan_motion.trajectory)  # -> out, start_configuration, configurations, fraction, time, planes, P, V, A
# ---------- trajectory_visualize: Python ----------
"""
Visualizes a trajectory.

COMPAS FAB v1.0.2
"""

from compas_ghpython.drawing import draw_frame
from compas_ghpython.sets import list_to_ghtree


start_configuration = None
configurations = []
fraction = 0.0
time = 0.0

planes = []
positions = []
velocities = []
accelerations = []

if robot and trajectory:
    group = group or robot.main_group_name

    for c in trajectory.points:
        configurations.append(
            robot.merge_group_with_full_configuration(c, trajectory.start_configuration, group)
        )
        frame = robot.forward_kinematics(c, group, options=dict(solver="model"))
        planes.append(draw_frame(frame))
        positions.append(c.positions)
        velocities.append(c.velocities)
        accelerations.append(c.accelerations)

    start_configuration = trajectory.start_configuration
    fraction = trajectory.fraction
    time = trajectory.time_from_start

P = list_to_ghtree(list(zip(*positions)))
V = list_to_ghtree(list(zip(*velocities)))
A = list_to_ghtree(list(zip(*accelerations)))
# ---------- end trajectory_visualize ----------
pln = Python3Script(P=trajectory_visualize.planes)  # -> P
# ---------- pln: Python ----------
print("hi")
# ---------- end pln ----------
pline = PolyLine(Vertices=pln, Closed=False)
preview = CustomPreview(Geometry=pline, Material=ColourSwatch(SwatchColor=RGB(59, 137, 161)))

item = ListItem(List=trajectory_visualize.configurations, Index=Slider(0, range=0..100), Wrap=True)

list_4 = ValueList({"0 forward_kinematics": 0, "1 inverse_kinematics": 1, "2 plan_motion": 2}, selected="1 inverse_kinematics")
ik_configuration = Data(inverse_kinematics.ik_configuration)
fk_configuration_3 = Data(forward_kinematics)
filter_3 = StreamFilter(Gate=list_4, Stream0=fk_configuration_3, Stream1=ik_configuration, Stream2=item)

# ----
# Visualisation
show_end_effector_frame = BooleanToggle(True)
show_base_frame = BooleanToggle(False)
show_collision = BooleanToggle(False)
show_frames = BooleanToggle(True)
show_visual = BooleanToggle(True)
show_acm = BooleanToggle(True)
robot_visualize = Python3Script(
    robot=set.robot,
    configuration=filter_3,
    attached_collision_meshes=attached_collision_mesh.attached_collision_mesh,
    show_visual=show_visual,
    show_collision=show_collision,
    show_frames=show_frames,
    show_base_frame=show_base_frame,
    show_end_effector_frame=show_end_effector_frame,
    show_acm=show_acm)  # -> visual, collision, attached_meshes, frames, base_frame, ee_frame; inputs attached_collision_meshes: list
# ---------- robot_visualize: Python ----------
"""
Visualizes the robot.

COMPAS FAB v0.19.1
"""
from compas.geometry import Frame
from compas_rhino.conversions import frame_to_rhino_plane, mesh_to_rhino
from compas.geometry import Transformation


if robot:
    show_visual = True if show_visual is None else show_visual
    configuration = configuration or robot.zero_configuration()

    robot.update(configuration, visual=show_visual, collision=show_collision)
    compas_frames = robot.transformed_frames(configuration, group)
    print(len(compas_frames))

    if show_visual:
        visual = robot.draw_visual()

    if show_collision:
        collision = robot.draw_collision()

    if show_base_frame:
        base_compas_frame = compas_frames[0]
        base_frame = frame_to_rhino_plane(base_compas_frame)

    if show_end_effector_frame:
        ee_compas_frame = robot.forward_kinematics(
            configuration, group, options=dict(solver="model", link="tool0")
        )
        print(ee_compas_frame)
        # print(robot.get_end_effector_frame())
        # if robot.attached_tool:
        #     ee_compas_frame = robot.from_t0cf_to_tcf([ee_compas_frame])[0]
        ee_frame = frame_to_rhino_plane(ee_compas_frame)

    if show_frames:
        frames = []
        for compas_frame in compas_frames[1:]:
            frame = frame_to_rhino_plane(compas_frame)
            frames.append(frame)

    if show_acm:
        attached_meshes = []

        for acm in attached_collision_meshes:
            frame = robot.forward_kinematics(configuration, options=dict(solver='model', link_name=acm.link_name))
            T = Transformation.from_frame_to_frame(Frame.worldXY(), frame)
            mesh = acm.collision_mesh.mesh.transformed(T)
            attached_meshes.append(mesh_to_rhino(mesh))

print(visual, collision, attached_meshes, frames, base_frame, ee_frame)
# ---------- end robot_visualize ----------
draw = Python3Script(frames=[robot_visualize.ee_frame, robot_visualize.frames, robot_visualize.base_frame], scale=Slider(0.2, range=0..1))  # -> P, V, C, W; inputs frames: list of Plane
# ---------- draw: Python ----------
from System.Drawing import Color
#from compas_ghpython.artists import FrameArtist
from compas.geometry import Frame
from compas_rhino.conversions import frame_to_rhino


red = Color.FromArgb(255, 0, 0)
green = Color.FromArgb(0, 255, 0)
blue = Color.FromArgb(0, 0, 255)

P = []
V = []
C = []

scale = float(scale)

for plane in frames:
    if not plane:
        continue
    P += [plane.Origin] * 3
    V.append(plane.XAxis * scale)
    V.append(plane.YAxis * scale)
    V.append(plane.ZAxis * scale)
    C += [red, green, blue]

W = 3
# ---------- end draw ----------
geo = Geometry([robot_visualize.visual, robot_visualize.collision, robot_visualize.attached_meshes])
preview_2 = CustomPreview(Geometry=geo, Shader=ColourSwatch(SwatchColor=RGB(207, 157, 160)))
vdisex_2 = VectorDisplayEx(Point=draw.P, Vector=draw.V, Colour=draw.C, Width=draw.W)

toggle = BooleanToggle(False)

# ----
# Move Joints
tcp_speed = Slider(98, range=0..1000)
to_joints = Button()
movej_command = Python3Script(robot=set.robot, configuration=filter_3, speed=tcp_speed, move_to_joints=to_joints)  # -> out
# ---------- movej_command: Python ----------
import abb_fabrication_control as afc
import compas_rrc as rrc

if move_to_joints:
    afc.commands.move_to_joints(robot, configuration, speed=speed, zone=rrc.Zone.FINE)
# ---------- end movej_command ----------
data_recorder = DataRecorder(movej_command, DataLimit=-10, RecordData=True)
out_2 = Panel(data_recorder)

to_frame = Button()

# ----
# Robot Control
# Move Cartesian
tcp_speed_2 = Slider(250, range=0..1000)
to_frame_2 = Button()
target_plane = Plane()
movel_command = Python3Script(
    robot=set.robot,
    configuration=filter_3,
    speed=tcp_speed_2,
    target_plane=target_plane,
    move_to_frame=to_frame_2,
    set_tool=to_frame)  # -> out; inputs target_plane: Plane
# ---------- movel_command: Python ----------
import compas_rrc as rrc
import abb_fabrication_control as afc
from compas.geometry import Frame

#set tool in RobotStudio
if set_tool:
    if robot.attached_tool:
        tool_name = robot.attached_tool.name
        done = robot.abb_client.send(rrc.SetTool(tool_name))
        print(done)
    else:
        robot.abb_client.send(rrc.SetTool("tool0"))

if move_to_frame:
    #robot.abb_client.send(rrc.SetTool(tool_name))
    #transform target plane into target frame
    target_frame = Frame(target_plane.Origin, target_plane.XAxis, target_plane.YAxis)
    print(target_plane)
    #send move to frame command
    afc.commands.move_to_frame(robot, target_frame, speed=speed, zone=rrc.Zone.FINE, scalefactor=1000)
# ---------- end movel_command ----------
data_recorder_2 = DataRecorder(movel_command, DataLimit=-10, RecordData=True)
out_3 = Panel(data_recorder_2)

print = Button()
# Hello robot!
py3_3 = Python3Script(robot=robot_2, send_text=print)  # -> out, a
# ---------- py3_3: Python ----------
from abb_fabrication_control.commands import print_text

if send_text and robot.abb_client:
    print_text(robot, 'Hello Robot!!!')
# ---------- end py3_3 ----------

get_frame = Button()
get_robtarget = Button()
get_joints = Button()

get_joints_2 = Python3Script(robot=set.robot, get_frame=get_frame, get_robtarget=get_robtarget, get_joints=get_joints)  # -> joint, current_plane
# ---------- get_joints_2: Python ----------
from scriptcontext import sticky as st
import abb_fabrication_control as afc
import os

from compas_rhino.conversions import frame_to_rhino_plane

# store robot in component
guid = str(ghenv.Component.InstanceGuid)
current_frame_key = "current_frame_" + guid
current_robtarget_key = "current_robtarget_" + guid
current_configuration_key = "current_configuration_" + guid

if current_frame_key not in st:
    st[current_frame_key] = None

if current_robtarget_key not in st:
    st[current_robtarget_key] = None

if current_configuration_key not in st:
    st[current_configuration_key] = None


#get commands
if get_frame:
    current_frame = afc.position.get_frame(robot, scalefactor=0.001)
    st[current_frame_key] = current_frame

if get_robtarget:
    current_robtarget = afc.position.get_robtarget(robot, scalefactor=0.001)
    print(current_robtarget)
    st[current_robtarget_key] = current_robtarget


if get_joints:
    current_configuration = afc.position.get_joints(robot)
    st[current_configuration_key] = current_configuration
    print(current_configuration)

# sticky
if st[current_frame_key]:
    current_frame = st[current_frame_key]
    current_plane = frame_to_rhino_plane(current_frame)

if st[current_robtarget_key]:
    current_robtarget = st[current_robtarget_key]

if st[current_configuration_key]:
    current_configuration = st[current_configuration_key]
# ---------- end get_joints_2 ----------

# ----
# Get Robot Configurations
number_slider_2 = Slider(0.2, range=0..1)
data_recorder_3 = DataRecorder(get_joints_2.joint, DataLimit=-10, RecordData=True)
draw_2 = Python3Script(plane=get_joints_2.current_plane, scale=number_slider_2)  # -> P, V, C, W; inputs scale: String
# ---------- draw_2: Python ----------
from System.Drawing import Color
from compas.geometry import Frame
from compas_rhino.conversions import frame_to_rhino

red = Color.FromArgb(255, 0, 0)
green = Color.FromArgb(0, 255, 0)
blue = Color.FromArgb(0, 0, 255)

P = []
V = []
C = []

scale = float(scale)


if plane:
    P += [plane.Origin] * 3
    V.append(plane.XAxis * scale)
    V.append(plane.YAxis * scale)
    V.append(plane.ZAxis * scale)
    C += [red, green, blue]
    
    W = 3
# ---------- end draw_2 ----------
joint_values = Panel(data_recorder_3)
vdisex_3 = VectorDisplayEx(Point=draw_2.P, Vector=draw_2.V, Colour=draw_2.C, Width=draw_2.W)

panel_7 = Panel(get_joints_2.joint)

# ==== cluster Tools

# ---- group: Wasp extruder
# wasp extruder
geo = Geometry([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])
mesh = Mesh(geo)
show = BooleanToggle(False)
mjoin = MeshJoin(Meshes=mesh)
yaxis_line = Curve(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)
xaxis_line = Curve(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)
tool = Python3Script(name="t_wasp_extruder", visual_mesh=mjoin, xline=yaxis_line, yline=xaxis_line, show=show)  # -> out, tool, tool_plane, tool_geometry, tool_frame_rs; inputs visual_mesh: Mesh, xline: Line, yline: Line
# ---------- tool: Python ----------
from __future__ import print_function

import Rhino.Geometry as rg
import os, math
from compas.geometry import Frame, Rotation
from compas.datastructures import Mesh
from compas_fab.robots import Tool


from compas_rhino.conversions import plane_to_compas_frame, mesh_to_compas, mesh_to_rhino

xaxis = xline
yaxis = yline

if xaxis.From.DistanceTo(yaxis.From) < 0.01:
    origin = xaxis.From
    xaxis = xaxis.Direction
    yaxis = yaxis.Direction
elif xaxis.To.DistanceTo(yaxis.To) < 0.01:
    origin = xaxis.To
    xaxis = -xaxis.Direction
    yaxis = -yaxis.Direction
elif xaxis.From.DistanceTo(yaxis.To) < 0.01:
    origin = xaxis.From
    xaxis = xaxis.Direction
    yaxis = -yaxis.Direction
elif xaxis.To.DistanceTo(yaxis.From) < 0.01:
    origin = xaxis.To
    xaxis = -xaxis.Direction
    yaxis = yaxis.Direction

xaxis.Unitize()
yaxis.Unitize()

plane = rg.Plane(origin, xaxis, yaxis)

frame = plane_to_compas_frame(plane) # convert to copmas frame
c_visual_mesh = mesh_to_compas(visual_mesh) # convert to compas mesh

# create Tool
# tool = Tool(c_visual_mesh, frame, name=name, connected_to="tool0")
tool = Tool(c_visual_mesh, frame, name=name)

# create values for Robot Studio tool (in mm and quaternion format)
tool_frame_rs = [[entry*1000 for entry in list(frame.point)], list(frame.quaternion)]

# round values
tool_frame_rs = str([[round(v, 5) for v in tool_frame_rs[0]], [round(v, 5) for v in tool_frame_rs[1]]])


if show:
    #print(("The tool {} will be connected to {}").format(tool.name, tool.connected_to))
    tool_plane = plane
    tool_geometry = mesh_to_rhino(c_visual_mesh)
else: 
    tool_plane = []
    tool_geometry = []


print(tool_frame_rs)
# ---------- end tool ----------

# ----
G = ClusterInput()
mesh_2 = Mesh(tool.tool_geometry)
preview = CustomPreview(Geometry=mesh_2, Shader=ColourSwatch(SwatchColor=RGBA(207, 157, 160, 157)))
values_for_abb_robot_studio = Panel(tool.tool)
draw = Python3Script(planes=tool.tool_plane, scale=Slider(0.2, range=0..1))  # -> out, P, V, C, W; inputs planes: list of Plane
# ---------- draw: Python ----------
from System.Drawing import Color

red = Color.FromArgb(255, 0, 0)
green = Color.FromArgb(0, 255, 0)
blue = Color.FromArgb(0, 0, 255)

P = []
V = []
C = []

scale = float(scale)

for plane in planes:
    if not plane:
        continue
    P += [plane.Origin] * 3
    V.append(plane.XAxis * scale)
    V.append(plane.YAxis * scale)
    V.append(plane.ZAxis * scale)
    C += [red, green, blue]

W = 3
# ---------- end draw ----------
vdisex = VectorDisplayEx(Point=draw.P, Vector=draw.V, Colour=draw.C, Width=draw.W)

# ---- group: Gives planning error without, needs better fix
Z = UnitZ(Factor="0.0000001")

# ---- group: measurement tool
geo_2 = Geometry(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)
mesh_3 = Mesh(geo_2)
xaxis_line_2 = Curve(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)
yaxis_line_2 = Curve(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)

# ---- group: Gives planning error without, needs better fix (continued)
move = Move(Geometry=mesh_3, Motion=Z)  # -> Geometry, Transform

# ---- group: measurement tool (continued)
mjoin_2 = MeshJoin(Meshes=move.Geometry)
tool_2 = Python3Script(rhmesh=mjoin_2, xline=xaxis_line_2, yline=yaxis_line_2)  # -> tool; inputs rhmesh: Mesh, xline: Line, yline: Line
# ---------- tool_2: Python ----------
import Rhino.Geometry as rg
import os, math
from compas.geometry import Frame, Rotation
from compas.datastructures import Mesh
from compas_rhino.conversions import mesh_to_compas
#from compas_ghpython.scene import MeshObject
from compas_fab.robots import Tool
#from compas_rhino.scene import RhinoMeshObject

#xaxis = rg.Line(xline.From, xline.To)
#yaxis = rg.Line(yline.PointAtStart, yline.PointAtEnd)
xaxis = xline
yaxis = yline

if xaxis.From.DistanceTo(yaxis.From) < 0.01:
    origin = xaxis.From
    xaxis = xaxis.Direction
    yaxis = yaxis.Direction
elif xaxis.To.DistanceTo(yaxis.To) < 0.01:
    origin = xaxis.To
    xaxis = -xaxis.Direction
    yaxis = -yaxis.Direction
elif xaxis.From.DistanceTo(yaxis.To) < 0.01:
    origin = xaxis.From
    xaxis = xaxis.Direction
    yaxis = -yaxis.Direction
elif xaxis.To.DistanceTo(yaxis.From) < 0.01:
    origin = xaxis.To
    xaxis = -xaxis.Direction
    yaxis = yaxis.Direction

xaxis.Unitize()
yaxis.Unitize()

ee_frame = Frame(origin, xaxis, yaxis)
ee_mesh = mesh_to_compas(rhmesh)

tool = Tool(ee_mesh, ee_frame, connected_to="tool0")
# ---------- end tool_2 ----------

# ----
filter = StreamFilter(Gate=G, Stream0=tool_2, Stream1=tool.tool)
s_0 = ClusterOutput(filter)
