# Grasshopper definition crb15000_control.ghx (Grasshopper 1.0.7)

reload = Button()
path = PythonScript()  # -> HERE, DATA, ROBOT_DESCRIPTION
# ---------- path: Python ----------
import os

HERE = os.path.dirname(ghdoc.Path)
DATA = os.path.abspath(os.path.join(HERE, "..", "data"))
ROBOT_DESCRIPTION = os.path.abspath(os.path.join(DATA, "robot_description"))

print(HERE)
print(DATA)
print(ROBOT_DESCRIPTION)
# ---------- end path ----------
py = PythonScript(reload=reload)
# ---------- py: Python ----------
if reload:
    from compas_ghpython import unload_modules
    unload_modules('compas')
    unload_modules("compas_fab")
    unload_modules("fabtory_fabrication_control")
    unload_modules("compas_rrc")
# ---------- end py ----------

# ----
# ROS client
ip = ValueList({"127.0.0.1", "192.168.0.4"}, selected="127.0.0.1")
robot_port = ValueList({"9090", "30101"}, selected="9090")
ros = ROSConnect(ip=ip, port=robot_port, connect=Toggle(True))  # -> ros_client, is_connected; inputs port: Int32, connect: Boolean
#   port ip: The ip address ROS. Defaults to 127.0.0.1.
# ---------- ros: Python ----------
from ghpythonlib.componentbase import executingcomponent as component
from scriptcontext import sticky as st

from compas_fab.backends import RosClient
from compas_fab.ghpython.components import create_id


class ROSConnect(component):
    def RunScript(self, ip, port, connect):
        ros_client = None

        ip = ip or '127.0.0.1'
        port = port or 9090

        key = create_id(self, 'ros_client')
        ros_client = st.get(key, None)

        if ros_client:
            st[key].close()
        if connect:
            st[key] = RosClient(ip, port)
            st[key].run(5)

        ros_client = st.get(key, None)
        is_connected = ros_client.is_connected if ros_client else False
        return (ros_client, is_connected)
# ---------- end ros ----------
is_connected = Panel(ros.is_connected)

abb = GhPythonScript(ros_client=ros.ros_client, connect=Toggle(True))  # -> out, abb_client; inputs connect: Boolean
# ---------- abb: Python ----------
import compas_rrc as rrc

if ros_client:
    if ros_client.is_connected and connect: 
        # Create ABB Client
        abb_client = rrc.AbbClient(ros_client, '/rob1')
# ---------- end abb ----------

# ----
# Define Points
pt = Point([<point referenced from the Rhino model> x3])
pointstoframes = GhPythonScript(points=pt)  # -> out, frames; inputs points: list of Point3d
# ---------- pointstoframes: Python ----------
__author__ = "julia"
__version__ = "2022.04.12"

import rhinoscriptsyntax as rs
from compas.geometry import Point, Frame, Vector

vector1 = Vector(-1,0,0)
vector2 = Vector(0,1,0)

frames = []

for point in points:
    frame_point = Point(point[0]*1000, point[1]*1000, point[2]*1000)
    print(frame_point)
    frame = Frame(frame_point, vector1, vector2)
    frames.append(frame)
# ---------- end pointstoframes ----------

# ----
# Tool
panel = Panel("Attach a custom tool")
list = ValueList({"measurement_tool": 0, "concrete_extruder": 1}, selected="concrete_extruder")
tools = Tools(G=list)
remove = Button()
add = Button()

# ----
# Load Model
# Load robot from local package
load = Button()
list_2 = ValueList({"abb_crb15000"}, selected="abb_crb15000")
units = ValueList({"m": 1, "cm": 100, "mm": 1000}, selected="m")

# ----
# Robot Model
panel_2 = Panel("abb_crb15000_5_95.srdf")

load_model = PythonScript(
    path=path.ROBOT_DESCRIPTION,
    package=list_2,
    urdf_name="abb_crb15000_5_95.urdf",
    srdf_name=panel_2,
    scale_factor=units,
    load=load)  # -> robot
# ---------- load_model: Python ----------
import os
from scriptcontext import sticky as st
import compas
from compas.robots import RobotModel
from compas.robots import LocalPackageMeshLoader
from compas_fab.robots import Robot
from compas_fab.robots import RobotSemantics
from compas_fab.ghpython import RobotArtist

packages = ["abb_crb15000_support", "abb_end_effectors", "abb_crb15000"]
loaders = []

for package in packages:
    loaders.append(LocalPackageMeshLoader(path, package))

#path directory
package_path = os.path.join(path, package)
print(package_path)

urdf_filename = os.path.join(package_path, "urdf", urdf_name)
srdf_filename = os.path.join(package_path, srdf_name)

assert os.path.isfile(urdf_filename)
assert os.path.isfile(srdf_filename)

compas.PRECISION = '12f'

# store robot in component
guid = str(ghenv.Component.InstanceGuid)
robot_key = "robot_" + guid

if robot_key not in st:
    st[robot_key] = None

#load robot model from urdf
if load:
    model = RobotModel.from_urdf_file(urdf_filename)
    model.load_geometry(*loaders)
    artist = RobotArtist(model)
    semantics = RobotSemantics.from_srdf_file(srdf_filename, model)
    robot = Robot(model, artist, semantics, client=None)

    st[robot_key] = robot
robot = st[robot_key]

#vizualize robot in the right scale of your environment
robot.scale(scale_factor)
# ---------- end load_model ----------

attach_remove = PythonScript(robot=load_model, tool=tools, attach=add, remove=remove)  # -> out, bang
# ---------- attach_remove: Python ----------
if attach:
    robot.attach_tool(tool)
if remove:
    robot.detach_tool()
# ---------- end attach_remove ----------

set = PythonScript(robot=load_model, ros_client=ros.ros_client, abb_client=abb.abb_client)  # -> out, robot, main_group_name
# ---------- set: Python ----------
if robot and ros_client and abb_client:
    robot.ros_client = ros_client
    robot.abb_client = abb_client

    robot.info()
    main_group_name = robot.main_group_name
# ---------- end set ----------

robot_info = Panel(set.out)

# ----
# forward kinematics
number_slider = Slider(0, range=-400..400)
# Configuration
jp = GhPythonScript()  # -> configuration_values
# ---------- jp: Python ----------
import math
joint_values = [-3.136, -0.328, -1.218, 3.129, 0.852, 0.008]
#joint_values = [math.degrees(j) for j in joint_values]
#joint_positions = [0] * 6


configuration_values = [0,0,0,0,0,0]
# ---------- end jp ----------
forward_kinematics = PythonScript(
    robot=set.robot,
    reset_configuration=Button(),
    configuration_values=jp,
    a_a1=Slider(59.8, range=-180..180),
    a_a2=Slider(34.1, range=-90..150),
    a_a3=Slider(25, range=-180..180),
    a_a4=Slider(0, range=-400..400),
    a_a5=Slider(30.5, range=-125..120),
    a_a6=number_slider)  # -> full_configuration; inputs reset_configuration: Boolean, configuration_values: list
# ---------- forward_kinematics: Python ----------
import math
import Grasshopper
import copy
from compas.robots import Joint
from compas_fab.robots import Configuration





if reset_configuration:
    j = 0
    for i in range(ghenv.Component.Params.Input.Count):
        nslider = ghenv.Component.Params.Input[i].Sources[0]
        if nslider.GetType() == Grasshopper.Kernel.Special.GH_NumberSlider:
            nslider.TrySetSliderValue(configuration_values[j])
            j += 1


if robot:
    joint_positions = [a_a1, a_a2, a_a3, a_a4, a_a5, a_a6]
    print joint_positions
    joint_positions_degrees = copy.deepcopy(joint_positions)
    joint_types = robot.get_configurable_joint_types()
    print(joint_types)
    for i, joint_type in enumerate(joint_types):
        if joint_type == Joint.REVOLUTE:
            joint_positions[i] = math.radians(joint_positions[i])
        if joint_type == Joint.PRISMATIC:
            joint_positions[i] = joint_positions[i]
    full_configuration = Configuration(joint_positions, joint_types)
    print full_configuration
# ---------- end forward_kinematics ----------

# ----
# Move Joints
tcp_speed = Slider(95, range=0..1000)
to_joints = Button()
movej_command = GhPythonScript(robot=set.robot, configuration=forward_kinematics, speed=tcp_speed, move_to_joints=to_joints)  # -> out; inputs move_to_joints: Boolean
# ---------- movej_command: Python ----------
import compas_rrc as rrc
from compas.robots import Joint
import math



if move_to_joints:
    joints = [] # store joint values in degree from configuration
    for i, joint_type in enumerate(configuration.joint_types):
        if joint_type == Joint.REVOLUTE:
            joints.append(math.degrees(configuration.joint_values[i]))
    joints = rrc.RobotJoints(joints)
    print(joints)
    print(configuration)
    
    robot_joints, external_axes = robot.abb_client.send_and_wait(rrc.GetJoints())
    robot.abb_client.send(rrc.MoveToJoints(joints, external_axes, speed, rrc.Zone.FINE))
# ---------- end movej_command ----------
data_recorder = DataRecorder(movej_command, DataLimit=-10, RecordData=True)
out = Panel(data_recorder)

# ----
# Move To Points
tcp_speed_2 = Slider(95, range=0..1000)
to_frames = Button()
movej_command_2 = GhPythonScript(
    robot=set.robot,
    configuration=forward_kinematics,
    speed=tcp_speed_2,
    move_to_frame=to_frames,
    frames=pointstoframes.frames)  # -> out; inputs move_to_frame: Boolean, frames: list
# ---------- movej_command_2: Python ----------
import compas_rrc as rrc
from compas.robots import Joint
import math



if move_to_frame:
    for frame in frames:
        robot.abb_client.send(rrc.MoveToFrame(frame, speed, rrc.Zone.FINE, rrc.Motion.LINEAR))
# ---------- end movej_command_2 ----------
data_recorder_2 = DataRecorder(movej_command_2, DataLimit=-10, RecordData=True)
out_2 = Panel(data_recorder_2)

# ----
# Visualisation
show_end_effector_frame = BooleanToggle(False)
show_base_frame = BooleanToggle(False)
show_collision = BooleanToggle(False)
show_frames = BooleanToggle(False)
show_visual = BooleanToggle(True)
show_acm = BooleanToggle(False)
robot_visualize = RobotVisualize(
    robot=set.robot,
    group=set.main_group_name,
    configuration=forward_kinematics,
    redraw=attach_remove.bang,
    show_visual=show_visual,
    show_collision=show_collision,
    show_frames=show_frames,
    show_base_frame=show_base_frame,
    show_end_effector_frame=show_end_effector_frame,
    show_acm=show_acm)  # -> visual, collision, attached_meshes, frames, base_frame, ee_frame; inputs redraw: list, show_visual: Boolean, show_collision: Boolean, show_frames: Boolean, show_base_frame: Boolean, show_end_effector_frame: Boolean, show_acm: Boolean
#   port group: The planning group used for end-effector and base visualization.
#   port configuration: The robot's full configuration.
#   port redraw: A list of attached collision meshes.
#   port show_visual: Whether or not to show the robot's visual meshes.
#   port show_collision: Whether or not to show the robot's collision meshes.
#   port show_frames: Whether or not to show the robot's joint frames.
#   port show_base_frame: Whether or not to show the robot's base frame.
#   port show_end_effector_frame: Whether or not to show the robot's end-effector frame.
#   port show_acm: Whether or not to show the attached collision meshes (if any).
#   port visual: The robot's visual Rhino meshes (if any).
#   port collision: The robot's collision Rhino meshes (if any).
#   port attached_meshes: The attached collision Rhino meshes (if any).
#   port frames: The robot's joint frames as Rhino planes (if any).
#   port base_frame: The robot's base frame as a Rhino plane (if any).
#   port ee_frame: The robot's end-effector frame as a Rhino plane (if any).
# ---------- robot_visualize: Python ----------
"""
Visualizes the robot.

COMPAS FAB v0.19.1
"""
from compas.geometry import Frame
from compas.geometry import Transformation
from compas_ghpython.artists import FrameArtist
from compas_ghpython.artists import MeshArtist
from ghpythonlib.componentbase import executingcomponent as component


class RobotVisualize(component):
    def RunScript(self, robot, group, configuration, attached_collision_meshes, show_visual, show_collision,
                  show_frames, show_base_frame, show_end_effector_frame, show_acm):

        visual = None
        collision = None
        attached_meshes = None
        frames = None
        base_frame = None
        ee_frame = None

        if robot:
            show_visual = True if show_visual is None else show_visual
            configuration = configuration or robot.zero_configuration()

            robot.update(configuration, visual=show_visual, collision=show_collision)
            compas_frames = robot.transformed_frames(configuration, group)

            if show_visual:               
                visual = robot.artist.draw_visual()
                

            if show_collision:
                collision = robot.artist.draw_collision()

            if show_base_frame:
                base_compas_frame = compas_frames[0]
                artist = FrameArtist(base_compas_frame)
                base_frame = artist.draw()

            if show_end_effector_frame:
                ee_compas_frame = robot.forward_kinematics(configuration, group, options=dict(solver='model'))
                if robot.attached_tool:
                    ee_compas_frame = robot.from_t0cf_to_tcf([ee_compas_frame])[0]
                artist = FrameArtist(ee_compas_frame)
                ee_frame = artist.draw()

            if show_frames:
                frames = []
                for compas_frame in compas_frames[1:]:
                    artist = FrameArtist(compas_frame)
                    frame = artist.draw()
                    frames.append(frame)

            if show_acm:
                attached_meshes = []
                for acm in attached_collision_meshes:
                    frame = robot.forward_kinematics(configuration, options=dict(solver='model', link_name=acm.link_name))
                    T = Transformation.from_frame_to_frame(Frame.worldXY(), frame)
                    mesh = acm.collision_mesh.mesh.transformed(T)
                    attached_meshes.append(MeshArtist(mesh).draw())

        return (visual, collision, attached_meshes, frames, base_frame, ee_frame)
# ---------- end robot_visualize ----------
draw = GhPythonScript(frames=[robot_visualize.frames, robot_visualize.base_frame, robot_visualize.ee_frame], scale=Slider(0.2, range=0..1))  # -> P, V, C, W; inputs frames: list
# ---------- draw: Python ----------
from System.Drawing import Color
from compas_ghpython.artists import FrameArtist

red = Color.FromArgb(255, 0, 0)
green = Color.FromArgb(0, 255, 0)
blue = Color.FromArgb(0, 0, 255)

P = []
V = []
C = []

scale = float(scale)

for plane in frames:
    if not plane:
        continue
    P += [plane.Origin] * 3
    V.append(plane.XAxis * scale)
    V.append(plane.YAxis * scale)
    V.append(plane.ZAxis * scale)
    C += [red, green, blue]

W = 3
# ---------- end draw ----------
geo = Geometry([robot_visualize.visual, robot_visualize.collision, robot_visualize.attached_meshes])
preview = CustomPreview(Geometry=geo, Shader=ColourSwatch(SwatchColor=RGB(207, 157, 160)))
vdisex = VectorDisplayEx(Point=draw.P, Vector=draw.V, Colour=draw.C, Width=draw.W)

# ----
# inverse kinematics
py_2 = PythonScript()  # -> configuration
# ---------- py_2: Python ----------
from compas_fab.robots import Configuration

if robot:
    types = robot.get_configurable_joint_types()
    values = [0] * len(types)
    configuration = Configuration(values, types)
    print configuration
    print robot.get_configurable_joint_names()
# ---------- end py_2 ----------
fk_configuration = Data(forward_kinematics)
go_to_start_configuration = BooleanToggle(False)
list_3 = ValueList({"0", "1"}, selected="0")
avoid_collisions = BooleanToggle(False)
compute = Button()
filter = StreamFilter(Gate=list_3, Stream0=fk_configuration, Stream1=py_2)
inverse_kinematics = GhPythonScript(
    compute=compute,
    robot=set.robot,
    group=set.main_group_name,
    frames=pointstoframes.frames,
    start_configuration=filter,
    go_to_start_configuration=go_to_start_configuration,
    avoid_collisions=avoid_collisions)  # -> out, ik_configuration, t0cp; inputs frames: list
# ---------- inverse_kinematics: Python ----------
from __future__ import print_function
import logging
from compas.geometry import Frame
from scriptcontext import sticky as st
from compas_ghpython.artists import FrameArtist

LOGGER = logging.getLogger('roslibpy')

#vizualize t0cf
if robot.attached_tool:
    t0cf = Frame(plane.Origin, plane.XAxis, plane.YAxis)
    t0cf = robot.from_tcf_to_t0cf([t0cf])[0]
    artist = FrameArtist(t0cf)
    t0cp = artist.draw()
    print (t0cf)


if compute:
    if robot.attached_tool:
        tool_attached = True
    else:
        tool_attached = False

    robot.client = robot.ros_client
    if go_to_start_configuration:
        ik_configuration = start_configuration
    else:
        
        frame = frames[0]
        if tool_attached:
            tool_frame = robot.from_tcf_to_t0cf([frame])[0]
        else:
            tool_frame = frame

        ik_configuration = robot.inverse_kinematics(tool_frame,
                                                      start_configuration,
                                                      group=group,
                                                      options={
                                                        'avoid_collisions':avoid_collisions,
                                                        'return_full_configuration':True,
                                                      })        
    #group_configuration = robot.get_group_configuration(group, ik_configuration)
    #print (group_configuration)
    st["ik_configuration"] = ik_configuration

#ik_configuration = st["ik_configuration"] 
print(ik_configuration)
# ---------- end inverse_kinematics ----------
draw_2 = GhPythonScript(planes=inverse_kinematics.t0cp, scale=Slider(0.2, range=0..1))  # -> P, V, C, W; inputs planes: list
# ---------- draw_2: Python ----------
from System.Drawing import Color
from compas_ghpython.artists import FrameArtist

red = Color.FromArgb(255, 0, 0)
green = Color.FromArgb(0, 255, 0)
blue = Color.FromArgb(0, 0, 255)

P = []
V = []
C = []

scale = float(scale)

for plane in planes:
    if not plane:
        continue
    P += [plane.Origin] * 3
    V.append(plane.XAxis * scale)
    V.append(plane.YAxis * scale)
    V.append(plane.ZAxis * scale)
    C += [red, green, blue]

W = 3
# ---------- end draw_2 ----------
vdisex_2 = VectorDisplayEx(Point=draw_2.P, Vector=draw_2.V, Colour=draw_2.C, Width=draw_2.W)

rec = DataRecorder(inverse_kinematics.out, DataLimit=-10, RecordData=True)

out_3 = Panel(rec)

list_4 = ValueList({"0 forward_kinematics": 0, "1 inverse_kinematics": 1}, selected="1 inverse_kinematics")
ik_configuration = Data(inverse_kinematics.ik_configuration)
fk_configuration_2 = Data(forward_kinematics)
filter_2 = StreamFilter(Gate=list_4, Stream0=fk_configuration_2, Stream1=ik_configuration)

# ----
# Visualisation
show_end_effector_frame_2 = BooleanToggle(True)
show_base_frame_2 = BooleanToggle(False)
show_collision_2 = BooleanToggle(False)
show_frames_2 = BooleanToggle(False)
show_visual_2 = BooleanToggle(True)
show_acm_2 = BooleanToggle(False)
robot_visualize_2 = RobotVisualize(
    configuration=filter_2,
    redraw=attach_remove.bang,
    show_visual=show_visual_2,
    show_collision=show_collision_2,
    show_frames=show_frames_2,
    show_base_frame=show_base_frame_2,
    show_end_effector_frame=show_end_effector_frame_2,
    show_acm=show_acm_2)  # -> visual, collision, attached_meshes, frames, base_frame, ee_frame; inputs redraw: list, show_visual: Boolean, show_collision: Boolean, show_frames: Boolean, show_base_frame: Boolean, show_end_effector_frame: Boolean, show_acm: Boolean; same code as robot_visualize
draw_3 = GhPythonScript(
    frames=[robot_visualize_2.frames, robot_visualize_2.base_frame, robot_visualize_2.ee_frame],
    scale=Slider(0.2, range=0..1))  # -> P, V, C, W; inputs frames: list; same code as draw
geo_2 = Geometry([robot_visualize_2.visual, robot_visualize_2.collision, robot_visualize_2.attached_meshes])
preview_2 = CustomPreview(Geometry=geo_2, Shader=ColourSwatch(SwatchColor=RGB(207, 157, 160)))
vdisex_3 = VectorDisplayEx(Point=draw_3.P, Vector=draw_3.V, Colour=draw_3.C, Width=draw_3.W)

# ==== cluster Tools

# ---- group: measurement tool
geo = Geometry(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)
mesh = Mesh(geo)
mjoin = MeshJoin(Meshes=mesh)
xaxis_line = Curve(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)
yaxis_line = Curve(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)
tool = PythonScript(rhmesh=mjoin, xline=xaxis_line, yline=yaxis_line)  # -> tool; inputs rhmesh: Mesh
# ---------- tool: Python ----------
import Rhino.Geometry as rg
import os, math
from compas.geometry import Frame, Rotation
from compas.datastructures import Mesh
from compas_ghpython.artists import MeshArtist
from compas_fab.robots import Tool
from compas_rhino.geometry import RhinoMesh

xaxis = rg.Line(xline.PointAtStart, xline.PointAtEnd)
yaxis = rg.Line(yline.PointAtStart, yline.PointAtEnd)

if xaxis.From.DistanceTo(yaxis.From) < 0.01:
    origin = xaxis.From
    xaxis = xaxis.Direction
    yaxis = yaxis.Direction
elif xaxis.To.DistanceTo(yaxis.To) < 0.01:
    origin = xaxis.To
    xaxis = -xaxis.Direction
    yaxis = -yaxis.Direction
elif xaxis.From.DistanceTo(yaxis.To) < 0.01:
    origin = xaxis.From
    xaxis = xaxis.Direction
    yaxis = -yaxis.Direction
elif xaxis.To.DistanceTo(yaxis.From) < 0.01:
    origin = xaxis.To
    xaxis = -xaxis.Direction
    yaxis = yaxis.Direction

xaxis.Unitize()
yaxis.Unitize()

ee_frame = Frame(origin, xaxis, yaxis)
ee_mesh = RhinoMesh.from_geometry(rhmesh).to_compas()

tool = Tool(ee_mesh, ee_frame)
# ---------- end tool ----------

# ---- group: concrete extruder tool
geo_2 = Geometry(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)
mesh_2 = Mesh(geo_2)
mjoin_2 = MeshJoin(Meshes=mesh_2)
yaxis_line_2 = Curve(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)
xaxis_line_2 = Curve(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)

# ----
tool_2 = PythonScript(rhmesh=mjoin_2, xline=xaxis_line_2, yline=yaxis_line_2)  # -> tool; inputs rhmesh: Mesh; same code as tool
G = ClusterInput()
filter = StreamFilter(Gate=G, Stream0=tool, Stream1=tool_2)
s_1 = ClusterOutput(filter)
