# Grasshopper definition crb15000_moveit_control.ghx (Grasshopper 1.0.7)

reload = Button()
path = PythonScript()  # -> HERE, DATA, ROBOT_DESCRIPTION
# ---------- path: Python ----------
import os

HERE = os.path.dirname(ghdoc.Path)
DATA = os.path.abspath(os.path.join(HERE, "..", "data"))
ROBOT_DESCRIPTION = os.path.abspath(os.path.join(DATA, "robot_description"))

print(HERE)
print(DATA)
print(ROBOT_DESCRIPTION)
# ---------- end path ----------
py = PythonScript(reload=reload)
# ---------- py: Python ----------
if reload:
    from compas_ghpython import unload_modules
    unload_modules('compas')
    unload_modules("compas_fab")
    unload_modules("fabtory_fabrication_control")
    unload_modules("compas_rrc")
# ---------- end py ----------

# ---- group: ROS client
disconnect = Button()
connect = Button()
list = ValueList({"local": 0, "linux computer": 1}, selected="local")
connect_2 = PythonScript(ip=list, connect=connect, disconnect=disconnect)  # -> out, ros_client
# ---------- connect_2: Python ----------
import sys
import scriptcontext as sc
from compas_fab.backends import RosClient

key = 'rosclient_%s' % str(ghenv.Component.InstanceGuid)
previous_client = sc.sticky.get(key, None)

if previous_client and (connect or disconnect):
    previous_client.close()

if connect:
    if ip == 0: #local, own laptop
        ros_client = RosClient('127.0.0.1', 9090)
    elif ip == 1: # linux computer
        ros_client = RosClient('10.181.163.92', 9090)
    sc.sticky[key] = ros_client
    ros_client.run(5)

ros_client = sc.sticky.get(key, None)
print('ROS connected: {}'.format(ros_client.is_connected if ros_client else 'False'))
# ---------- end connect_2 ----------
is_connected = Panel(connect_2.out)
ros_client = Data(connect_2.ros_client)

# ----
# ROS Robot Model
# Load robot directly from ROS
# (only working if connected and file_server launched)
units = ValueList({"m": 1, "cm": 100, "mm": 1000}, selected="m")
load = Button()
python = PythonScript(client=ros_client, scale_factor=units, load=load)  # -> robot; inputs load: Boolean
# ---------- python: Python ----------
import os
from scriptcontext import sticky as st
import compas
from compas.robots import RobotModel
from compas_fab.backends import RosClient
from compas_fab.backends import RosFileServerLoader
from compas_fab.robots import Robot
from compas_fab.robots import RobotSemantics
from compas_fab.ghpython import RobotArtist

# Set high precision to import meshes defined in meters
compas.PRECISION = '24f'

# store robot in component
guid = str(ghenv.Component.InstanceGuid)
robot_key = "robot_" + guid

if robot_key not in st:
    st[robot_key] = None

if client and client.is_connected and load:
    # Load URDF from ROS
    loader = RosFileServerLoader(client)
    urdf = loader.load_urdf()
    srdf = loader.load_srdf()

    # Create robot model from URDF and load geometry
    model = RobotModel.from_urdf_string(urdf)
    model.load_geometry(loader)
    
    semantics = RobotSemantics.from_srdf_string(srdf, model)
    
    robot = Robot(model, semantics=semantics)
    robot.artist = RobotArtist(robot.model)
    robot.scale(scale_factor)
    st[robot_key] = robot

robot = st[robot_key]
if robot:
    robot.client = client
# ---------- end python ----------

# ----
# Local Robot Model
panel = Panel("abb_crb15000_5_95.srdf")

# ----
# Load Local Model
# Load robot from local package
load_2 = Button()
list_2 = ValueList({"abb_crb15000"}, selected="abb_crb15000")
units_2 = ValueList({"m": 1, "cm": 100, "mm": 1000}, selected="m")
load_model = PythonScript(
    path=path.ROBOT_DESCRIPTION,
    package=list_2,
    urdf_name="abb_crb15000_5_95.urdf",
    srdf_name=panel,
    scale_factor=units_2,
    load=load_2)  # -> robot
# ---------- load_model: Python ----------
import os
from scriptcontext import sticky as st
import compas
from compas.robots import RobotModel
from compas.robots import LocalPackageMeshLoader
from compas_fab.robots import Robot
from compas_fab.robots import RobotSemantics
from compas_fab.ghpython import RobotArtist

packages = ["abb_crb15000_support", "abb_end_effectors", "abb_crb15000"]
loaders = []

for package in packages:
    loaders.append(LocalPackageMeshLoader(path, package))

#path directory
package_path = os.path.join(path, package)
print(package_path)

urdf_filename = os.path.join(package_path, "urdf", urdf_name)
srdf_filename = os.path.join(package_path, srdf_name)

assert os.path.isfile(urdf_filename)
assert os.path.isfile(srdf_filename)

compas.PRECISION = '12f'

# store robot in component
guid = str(ghenv.Component.InstanceGuid)
robot_key = "robot_" + guid

if robot_key not in st:
    st[robot_key] = None

#load robot model from urdf
if load:
    model = RobotModel.from_urdf_file(urdf_filename)
    model.load_geometry(*loaders)
    artist = RobotArtist(model)
    semantics = RobotSemantics.from_srdf_file(srdf_filename, model)
    robot = Robot(model, artist, semantics, client=None)

    st[robot_key] = robot
robot = st[robot_key]

#vizualize robot in the right scale of your environment
robot.scale(scale_factor)
# ---------- end load_model ----------

# ----
# Input
pt = Point(Point(0.62116715, 0.5299532239, 0.3015280014))
panel_2 = Panel("Start plane")
panel_3 = Panel("End plane")
pt_2 = Point(Point(0.4148048473, 0.0806959495, 0.2818520837))
py_2 = GhPythonScript(pt=pt_2)  # -> pln
# ---------- py_2: Python ----------
import Rhino.Geometry as rg

pln = rg.Plane(pt, -rg.Vector3d.YAxis)
# ---------- end py_2 ----------
py_3 = GhPythonScript(pt=pt)  # -> pln; same code as py_2
end_plane = Plane(py_2)
start_plane = Plane(py_3)

# ----
# Tool
list_3 = ValueList({"measurement_tool": 0, "concrete_extruder": 1}, selected="concrete_extruder")
panel_4 = Panel("Attach a custom tool")
cluster = Cluster(tool_choice=list_3)  # -> tool_4, mesh_4
remove = Button()
acm = BooleanToggle(False)
add = Button()

# ----
# ABB client
list_4 = ValueList({"0 use from ROS": 0, "1 use from local package": 1}, selected="0 use from ROS")
filter = StreamFilter(Gate=list_4, Stream0=python, Stream1=load_model)
abb = GhPythonScript(ros_client=ros_client, connect=Toggle(True))  # -> out, abb_client; inputs connect: Boolean
# ---------- abb: Python ----------
import compas_rrc as rrc

if ros_client:
    if ros_client.is_connected and connect: 
        # Create ABB Client
        abb_client = rrc.AbbClient(ros_client, '/rob1')
# ---------- end abb ----------
set = PythonScript(robot=filter, ros_client=ros_client, abb_client=abb.abb_client)  # -> out, robot, main_group_name
# ---------- set: Python ----------
if robot and ros_client and abb_client:
    robot.ros_client = ros_client
    robot.abb_client = abb_client

    robot.info()
    main_group_name = robot.main_group_name
# ---------- end set ----------
remove_2 = Button()
collision_mesh = Mesh(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)
add_2 = Button()

add_cm = GhPythonScript(robot=set.robot, collision_mesh=collision_mesh, add_cm=add_2, remove_cm=remove_2)  # -> out, robot; inputs collision_mesh: Mesh, add_cm: Boolean, remove_cm: Boolean
# ---------- add_cm: Python ----------
from compas.datastructures import Mesh

import compas_fab
from compas_fab.backends import RosClient
from compas_fab.robots import CollisionMesh
from compas_fab.robots import PlanningScene
from compas_rhino.geometry import RhinoMesh

if add_cm:
    with RosClient() as client:
        scene = PlanningScene(robot)
        ee_mesh = RhinoMesh.from_geometry(collision_mesh).to_compas()
        cm = CollisionMesh(ee_mesh, 'table_surface')
        scene.add_collision_mesh(cm)

if remove_cm:
    with RosClient() as client:
        scene = PlanningScene(robot)
        scene.remove_collision_mesh("table_surface")
# ---------- end add_cm ----------

robot = Data(add_cm.robot)

attach_remove = PythonScript(robot=robot, tool=cluster.tool_4, attach=add, remove=remove, attach_collision_mesh=acm, collision_mesh=cluster.mesh_4)  # -> out, bang; inputs attach_collision_mesh: Boolean
# ---------- attach_remove: Python ----------
import compas_fab
from compas_fab.backends import RosClient
from compas_fab.robots import CollisionMesh
from compas_fab.robots import PlanningScene


scene = PlanningScene(robot)
if attach:
    robot.attach_tool(tool)
    if attach_collision_mesh:
        # create collison object
        acm = CollisionMesh(collision_mesh, 'tip')    
        # attach it to the end-effector
        group = robot.main_group_name
        scene.attach_collision_mesh_to_robot_end_effector(acm, group=group)
if remove:
    robot.detach_tool()
    scene.remove_attached_collision_mesh('tip')
# ---------- end attach_remove ----------

# ----
# Info
info = PythonScript(robot=robot)  # -> out, main_group_name
# ---------- info: Python ----------
if robot:
    robot.info()
    main_group_name = robot.main_group_name
# ---------- end info ----------
panel_5 = Panel(info.out)

# ---- group: forward kinematics
a5 = Slider(30, range=-360..360)
a1 = Slider(-14, range=-360..360)
a2 = Slider(-17, range=-360..360)
a3 = Slider(41, range=-360..360)
a6 = Slider(0, range=-360..360)
a4 = Slider(0, range=-360..360)
jp = GhPythonScript()  # -> joint_positions
# ---------- jp: Python ----------
import math

joint_positions = [0,16,41,0,30,0]
joint_positions = [math.radians(a) for a in joint_positions]

print joint_positions
# ---------- end jp ----------
forward_kinematics = PythonScript(robot=robot, set_joint_positions=Button(), joint_positions=jp, a1=a1, a2=a2, a3=a3, a4=a4, a5=a5, a6=a6)  # -> full_configuration; inputs joint_positions: list
# ---------- forward_kinematics: Python ----------
import math
import Grasshopper
from compas.robots import Joint
from compas_fab.robots import Configuration

if set_joint_positions:

    j = 0
    for i in range(ghenv.Component.Params.Input.Count):
        nslider = ghenv.Component.Params.Input[i].Sources[0]
        if nslider.GetType() == Grasshopper.Kernel.Special.GH_NumberSlider:
            nslider.TrySetSliderValue(math.degrees(joint_positions[j]))
            j += 1

if robot:
    joint_positions = [a1, a2, a3, a4, a5, a6]
    joint_types = robot.get_configurable_joint_types()
    for i, joint_type in enumerate(joint_types):
        if joint_type == Joint.REVOLUTE:
            joint_positions[i] = math.radians(joint_positions[i])
    full_configuration = Configuration(joint_positions, joint_types)

print(full_configuration)
# ---------- end forward_kinematics ----------

# ----
# RRC Move To Joints
tcp_speed = Slider(95, range=0..1000)
to_joints = Button()
movej_command = GhPythonScript(robot=robot, configuration=forward_kinematics, speed=tcp_speed, move_to_joints=to_joints)  # -> out; inputs move_to_joints: Boolean
# ---------- movej_command: Python ----------
import compas_rrc as rrc
from compas.robots import Joint
import math


if move_to_joints:
    joints = [] # store joint values in degree from configuration
    for i, joint_type in enumerate(configuration.joint_types):
        if joint_type == Joint.REVOLUTE:
            joints.append(math.degrees(configuration.joint_values[i]))
    joints = rrc.RobotJoints(joints)
    print(joints)
    print(configuration)
    
    robot_joints, external_axes = robot.abb_client.send_and_wait(rrc.GetJoints())
    robot.abb_client.send(rrc.MoveToJoints(joints, external_axes, speed, rrc.Zone.FINE))
# ---------- end movej_command ----------
data_recorder = DataRecorder(movej_command, DataLimit=-10, RecordData=True)
out = Panel(data_recorder)

# ---- group: inverse kinematics
py_4 = PythonScript(robot=robot)  # -> configuration
# ---------- py_4: Python ----------
from compas_fab.robots import Configuration

if robot:
    types = robot.get_configurable_joint_types()
    values = [0] * len(types)
    configuration = Configuration(values, types)
    print configuration
    print robot.get_configurable_joint_names()
# ---------- end py_4 ----------
start_configuration = Data(forward_kinematics)
list_5 = ValueList({"0", "1"}, selected="1")
filter_2 = StreamFilter(Gate=list_5, Stream0=start_configuration, Stream1=py_4)

# ----
# Configuration
# TODO Example:
# Add path constraints
main_planning_group = Text(info.main_group_name)
compute = Button()

# ---- group: inverse kinematics (continued)
inverse = PythonScript(robot=robot, group=main_planning_group, start_configuration=filter_2, plane=start_plane)  # -> out, configuration
# ---------- inverse: Python ----------
import scriptcontext as sc
import logging

from compas.geometry import Frame

from compas_fab.backends.ros import RosError
from compas_fab.robots import Configuration

LOGGER = logging.getLogger('roslibpy')

if robot:
    if robot.client:
        if robot.client.is_connected:
            frame = Frame(plane.Origin, plane.XAxis, plane.YAxis)
            configuration = robot.inverse_kinematics(frame, start_configuration, group)
            print(configuration)
        else:
            print("Robot is not connected")
    else:
        print("No client")
else:
    print("No robot")
# ---------- end inverse ----------
panel_6 = Panel(inverse.out)

# ---- group: cartesian motion
# Plan cartesian motion
group = Data(main_planning_group)
py_5 = PythonScript(start_plane=start_plane, end_plane=end_plane)  # -> planes
# ---------- py_5: Python ----------
planes = [start_plane, end_plane]
print planes
# ---------- end py_5 ----------
py_6 = PythonScript(robot=robot)  # -> configuration
# ---------- py_6: Python ----------
from compas_fab.robots import Configuration

if robot:
    types = robot.get_configurable_joint_types()
    values = [0] * len(types)

    configuration = Configuration(values, types)
    print configuration
# ---------- end py_6 ----------
start_configuration_2 = Data(inverse.configuration)
list_6 = ValueList({"0", "1"}, selected="0")
avoid_collisions = BooleanToggle(False)
compute_2 = Button()
filter_3 = StreamFilter(Gate=list_6, Stream0=start_configuration_2, Stream1=py_6)
plan_cartesian_motion = PythonScript(
    robot=robot,
    group=group,
    planes=py_5,
    start_configuration=filter_3,
    max_step=Slider(0.01, range=0..0.01),
    avoid_collisions=avoid_collisions,
    compute=compute_2)  # -> out, trajectory; inputs planes: list, avoid_collisions: Boolean
# ---------- plan_cartesian_motion: Python ----------
"""Calculates a cartesian motion path (linear in tool space).
    Inputs:
        robot: The robot
        group: str, optional
            The planning group used for calculation. Defaults to the robot's
            main planning group.
        planes: The planes in world coordinate frame through which the path is defined.
        start_configuration: :class:`compas_fab.robots.Configuration`, optional
            The robot's full configuration, i.e. values for all configurable
            joints of the entire robot cell, at the starting position. Defaults
            to the all-zero configuration.
        max_step: float
            The approximate distance between the calculated points. (Defined in
            the robot's units)
        avoid_collisions: bool, optional
            Whether or not to avoid collisions. Defaults to True.
        attached_collision_meshes: list of :class:`compas_fab.robots.AttachedCollisionMesh`
            Defaults to None.
        compute: bool
            Press to calculate solution.
    Output:
        :class:`compas_fab.robots.JointTrajectory`
            The calculated trajectory.
"""
from __future__ import print_function
import logging
import scriptcontext as sc

from compas.geometry import Frame

LOGGER = logging.getLogger('roslibpy')

guid = str(ghenv.Component.InstanceGuid)
response_key = "response_" + guid
if response_key not in sc.sticky:
    sc.sticky[response_key] = None

frames_WCF = [Frame(plane.Origin, plane.XAxis, plane.YAxis) for plane in planes]
frames_RCF = [robot.to_local_coordinates(frame_WCF, group=None) for frame_WCF in frames_WCF]
if robot.attached_tool:
    frames_RCF = [robot.from_tcf_to_t0cf([frame])[0] for frame in frames_RCF]


if robot and robot.client and start_configuration and compute:
    if robot.client.is_connected:
        sc.sticky[response_key] = robot.plan_cartesian_motion(frames_RCF,
                                                              start_configuration=start_configuration,
                                                              group=group,
                                                              options={
                                                                'max_step': float(max_step),
                                                                'avoid_collisions': bool(avoid_collisions)}
                                                              )
    else:
        print("Robot client is not connected")

trajectory = sc.sticky[response_key]
# ---------- end plan_cartesian_motion ----------
vis = PythonScript(response=plan_cartesian_motion.trajectory)  # -> P, V, A
# ---------- vis: Python ----------
from compas_ghpython import list_to_ghtree

if response:
    #print response.points
    positions = []
    velocities = []
    accelerations = []

    for p in response.points:
        positions.append(p.positions)
        velocities.append(p.velocities)
        accelerations.append(p.accelerations)
    #print positions
    P = list_to_ghtree(list(zip(*positions)))
    V = list_to_ghtree(list(zip(*velocities)))
    A = list_to_ghtree(list(zip(*accelerations)))
# ---------- end vis ----------
data_recorder_2 = DataRecorder(plan_cartesian_motion.out, DataLimit=-10, RecordData=True)
prismatic = QuickGraph(vis.P, SortOrder=0)
panel_7 = Panel("positions")
py_7 = PythonScript(robot=robot, group=group, trajectory=plan_cartesian_motion.trajectory)  # -> configurations, full_configurations, frames, planes, fraction, time
# ---------- py_7: Python ----------
from compas_ghpython import draw_frame

joint_positions = []

if trajectory:
    configurations = trajectory.points
    start_configuration = trajectory.start_configuration
    fraction = trajectory.fraction
    time = trajectory.time_from_start
    full_configurations = [robot.merge_group_with_full_configuration(c, trajectory.start_configuration, group) for c in configurations]
    frames = [robot.forward_kinematics(c, group, options=dict(solver='model')) for c in full_configurations]
    planes = [draw_frame(frame) for frame in frames]
    P = [plane.Origin for plane in planes]
# ---------- end py_7 ----------
fraction = Panel(py_7.fraction)
panel_8 = Panel(data_recorder_2)
graph = QuickGraph(vis.V, SortOrder=0)
graph_2 = QuickGraph(vis.A, SortOrder=0)
pline = PolyLine(Vertices=py_7.planes, Closed=False)
panel_9 = Panel("velocities")
panel_10 = Panel("accelerations")
start = Button()
reset = Button()
step = Button()
counter = CountThroughList(L=py_7.full_configurations, start=start, step=step, reset=reset)  # -> cartesian_motion_configuration; inputs L: list, start: Boolean
# ---------- counter: Python ----------
from scriptcontext import sticky as st
from compas_ghpython.utilities import update_component


interval = 1

# store data in component
guid = str(ghenv.Component.InstanceGuid)
counter_key = "counter_" + guid
running_key = "running_" + guid

if counter_key not in st:
    st[counter_key] = 0

if running_key not in st:
    st[running_key] = False

if start:
    st[running_key] = True

if step:
    if st[counter_key] < len(L) - 1:
        st[counter_key] += 1
    
if len(L):
    cartesian_motion_configuration = L[st[counter_key]]

if st[running_key]:
    if st[counter_key] < len(L) - 1:
        st[counter_key] += 1
        update_component(ghenv, interval)
    else:
        st[counter_key] = 0
        st[running_key] = False
# ---------- end counter ----------

# RRC Cartesian
tcp_speed_2 = Slider(95, range=0..1000)
to_frames = Button()
movej_command_2 = GhPythonScript(robot=robot, configuration=forward_kinematics, speed=tcp_speed_2, move_to_frame=to_frames, planes=py_5)  # -> out; inputs move_to_frame: Boolean, planes: list
# ---------- movej_command_2: Python ----------
import compas_rrc as rrc
from compas.robots import Joint
from compas.geometry import Frame, Plane
import math



if move_to_frame:
    for plane in planes:
        frame = Frame(plane[0], plane[1], plane[2])
        robot.abb_client.send(rrc.MoveToFrame(frame, speed, rrc.Zone.FINE, rrc.Motion.LINEAR))
# ---------- end movej_command_2 ----------
data_recorder_3 = DataRecorder(movej_command_2, DataLimit=-10, RecordData=True)
out_2 = Panel(data_recorder_3)

# ---- group: plan motion
# Plan Joint motion
# If you specify the tolerance vector with [360, 1, 1], it means that
#     the frame's y-axis and z-axis are allowed to rotate about the x-axis by an
#     angle of 360 degrees, whereas the x-axis can only change 1 degree.
number_slider = Slider(1, range=1..360)
goal_plane = Geometry(end_plane)
group_2 = Data(main_planning_group)
py_8 = PythonScript(robot=robot)  # -> configuration; same code as py_6
list_7 = ValueList({"don't use attached collision mesh": 0, "use attached collision mesh": 1}, selected="use attached collision mesh")
python_2 = PythonScript(
    robot=robot,
    group=group_2,
    goal_plane=goal_plane,
    tolerance_position=Slider(0.001, range=0..0.001),
    tolerance_xaxis_deg=number_slider,
    tolerance_yaxis_deg=Slider(1, range=1..360),
    tolerance_zaxis_deg=Slider(1, range=1..360))  # -> goal_constraints
# ---------- python_2: Python ----------
import math
from compas.geometry import Frame



frame_WCF = Frame(goal_plane.Origin, goal_plane.XAxis, goal_plane.YAxis)
frame_RCF = robot.to_local_coordinates(frame_WCF, group=None)

if robot.attached_tool:
    frame_RCF = robot.from_tcf_to_t0cf([frame_RCF])[0]

tolerances_axes = [math.radians(tolerance_xaxis_deg), math.radians(tolerance_yaxis_deg), math.radians(tolerance_zaxis_deg)]

if robot:
    goal_constraints = robot.constraints_from_frame(frame_RCF, tolerance_position, tolerances_axes, group)
# ---------- end python_2 ----------
start_configuration_3 = Data(inverse.configuration)
list_8 = ValueList({"0", "1"}, selected="0")
filter_4 = StreamFilter(Gate=list_8, Stream0=start_configuration_3, Stream1=py_8)
list_9 = ValueList({"RRT", "RRT*": "RRTStar", "EST", "PRM": "RPM", "PRM*": "RPMStar", "SPARS"}, selected="RRT")
start_2 = Button()
reset_2 = Button()
step_2 = Button()

# RRC Cartesian
tcp_speed_3 = Slider(95, range=0..1000)
to_frames_2 = Button()
movej_command_3 = GhPythonScript(robot=robot, configuration=forward_kinematics, speed=tcp_speed_3, move_to_frame=to_frames_2, goal_plane=goal_plane)  # -> out; inputs move_to_frame: Boolean
# ---------- movej_command_3: Python ----------
import compas_rrc as rrc
from compas.robots import Joint
from compas.geometry import Frame, Plane
import math



if move_to_frame:
    frame = Frame(goal_plane[0], goal_plane[1], goal_plane[2])
    robot.abb_client.send(rrc.MoveToFrame(frame, speed, rrc.Zone.FINE, rrc.Motion.JOINT))
# ---------- end movej_command_3 ----------
data_recorder_4 = DataRecorder(movej_command_3, DataLimit=-10, RecordData=True)
out_3 = Panel(data_recorder_4)

# ----
plan_motion = PythonScript(robot=robot, group=group_2, start_configuration=filter_4, goal_constraints=python_2, planner_id=list_9, compute=compute)  # -> out, trajectory; inputs goal_constraints: list
# ---------- plan_motion: Python ----------
"""Calculates a motion path.
    Inputs:
        robot: The robot
        group: str, optional
            The planning group used for calculation. Defaults to the robot's
            main planning group.
        start_configuration: :class:`compas_fab.robots.Configuration`, optional
            The robot's full configuration, i.e. values for all configurable
            joints of the entire robot cell, at the starting position. Defaults
            to the all-zero configuration.
        goal_constraints: list of :class:`compas_fab.robots.Constraint`
            The goal to be achieved, defined in a set of constraints.
            Constraints can be very specific, for example defining value domains
            for each joint, such that the goal configuration is included,
            or defining a volume in space, to which a specific robot link (e.g.
            the end-effector) is required to move to.
        planner_id: str
            The name of the algorithm used for path planning. Defaults to 'RRT'.
        attached_collision_meshes: list of :class:`compas_fab.robots.AttachedCollisionMesh`
            Defaults to None.
        compute: bool
            Press to calculate solution.
    Output:
        :class:`compas_fab.robots.JointTrajectory`
            The calculated trajectory.
"""
from __future__ import print_function
import logging
import scriptcontext as sc

guid = str(ghenv.Component.InstanceGuid)
response_key = "response_" + guid
if response_key not in sc.sticky:
    sc.sticky[response_key] = None

LOGGER = logging.getLogger('roslibpy')

if robot and robot.client and start_configuration and compute:
    if robot.client.is_connected:
        sc.sticky[response_key] = robot.plan_motion(goal_constraints,
                                                    start_configuration,
                                                    group,
                                                    options={
                                                        'planner_id': str(planner_id)
                                                    })
    else:
        print("Robot client is not connected.")

trajectory = sc.sticky[response_key]
# ---------- end plan_motion ----------
panel_14 = Panel(plan_motion.out)

# ---- group: plan motion (continued)
vis_2 = PythonScript(response=plan_motion.trajectory)  # -> P, V, A, time
# ---------- vis_2: Python ----------
from compas_ghpython import list_to_ghtree

if response:

    positions = []
    velocities = []
    accelerations = []
    time_from_start = []

    for p in response.points:
        positions.append(p.positions)
        velocities.append(p.velocities)
        accelerations.append(p.accelerations)
        time_from_start.append(p.time_from_start.seconds)

    P = list_to_ghtree(list(zip(*positions)))
    V = list_to_ghtree(list(zip(*velocities)))
    A = list_to_ghtree(list(zip(*accelerations)))

    time = time_from_start[-1]
    print time
# ---------- end vis_2 ----------
time_s = Panel(vis_2.time)
py_9 = PythonScript(robot=robot, group=group_2, trajectory=plan_motion.trajectory)  # -> start_configuration, configurations, full_configurations, frames, planes; same code as py_7
prismatic_2 = QuickGraph(vis_2.P, SortOrder=0)
pline_2 = PolyLine(Vertices=py_9.planes, Closed=False)
graph_3 = QuickGraph(vis_2.V, SortOrder=0)
graph_4 = QuickGraph(vis_2.A, SortOrder=0)
preview = CustomPreview(Geometry=pline_2, Material=ColourSwatch(SwatchColor=RGB(139, 59, 161)))
counter_2 = CountThroughList(L=py_9.full_configurations, start=start_2, step=step_2, reset=reset_2)  # -> joint_motion_configuration; inputs L: list, start: Boolean
# ---------- counter_2: Python ----------
from scriptcontext import sticky as st
from compas_ghpython.utilities import update_component


interval = 1

# store data in component
guid = str(ghenv.Component.InstanceGuid)
counter_key = "counter_" + guid
running_key = "running_" + guid

if counter_key not in st:
    st[counter_key] = 0

if running_key not in st:
    st[running_key] = False

if start:
    st[running_key] = True

if step:
    if st[counter_key] < len(L) - 1:
        st[counter_key] += 1
    
if len(L):
    joint_motion_configuration = L[st[counter_key]]

if st[running_key]:
    if st[counter_key] < len(L) - 1:
        st[counter_key] += 1
        update_component(ghenv, interval)
    else:
        st[counter_key] = 0
        st[running_key] = False
# ---------- end counter_2 ----------

# ----
list_10 = ValueList({"0 forward_kinematics": 0, "1 inverse_kinematics": 1, "2 cartesian_motion": 2, "3 joint_motion": 3}, selected="0 forward_kinematics")
cartesian_motion_configuration = Data(counter)
joint_motion_configuration = Data(counter_2)
fk_configuration = Data(forward_kinematics)
ik_configuration = Data(inverse.configuration)
filter_5 = StreamFilter(
    Gate=list_10,
    Stream0=fk_configuration,
    Stream1=ik_configuration,
    Stream2=cartesian_motion_configuration,
    Stream3=joint_motion_configuration)

# ----
# Visualisation
show_end_effector_frame = BooleanToggle(True)
show_base_frame = BooleanToggle(False)
show_collision = BooleanToggle(False)
show_frames = BooleanToggle(False)
show_visual = BooleanToggle(True)
show_acm = BooleanToggle(False)
robot_visualize = RobotVisualize(
    robot=robot,
    group=info.main_group_name,
    configuration=filter_5,
    redraw=attach_remove.bang,
    show_visual=show_visual,
    show_collision=show_collision,
    show_frames=show_frames,
    show_base_frame=show_base_frame,
    show_end_effector_frame=show_end_effector_frame,
    show_acm=show_acm)  # -> visual, collision, attached_meshes, frames, base_frame, ee_frame; inputs redraw: list, show_visual: Boolean, show_collision: Boolean, show_frames: Boolean, show_base_frame: Boolean, show_end_effector_frame: Boolean, show_acm: Boolean
#   port group: The planning group used for end-effector and base visualization.
#   port configuration: The robot's full configuration.
#   port redraw: A list of attached collision meshes.
#   port show_visual: Whether or not to show the robot's visual meshes.
#   port show_collision: Whether or not to show the robot's collision meshes.
#   port show_frames: Whether or not to show the robot's joint frames.
#   port show_base_frame: Whether or not to show the robot's base frame.
#   port show_end_effector_frame: Whether or not to show the robot's end-effector frame.
#   port show_acm: Whether or not to show the attached collision meshes (if any).
#   port visual: The robot's visual Rhino meshes (if any).
#   port collision: The robot's collision Rhino meshes (if any).
#   port attached_meshes: The attached collision Rhino meshes (if any).
#   port frames: The robot's joint frames as Rhino planes (if any).
#   port base_frame: The robot's base frame as a Rhino plane (if any).
#   port ee_frame: The robot's end-effector frame as a Rhino plane (if any).
# ---------- robot_visualize: Python ----------
"""
Visualizes the robot.

COMPAS FAB v0.19.1
"""
from compas.geometry import Frame
from compas.geometry import Transformation
from compas_ghpython.artists import FrameArtist
from compas_ghpython.artists import MeshArtist
from ghpythonlib.componentbase import executingcomponent as component


class RobotVisualize(component):
    def RunScript(self, robot, group, configuration, attached_collision_meshes, show_visual, show_collision,
                  show_frames, show_base_frame, show_end_effector_frame, show_acm):

        visual = None
        collision = None
        attached_meshes = None
        frames = None
        base_frame = None
        ee_frame = None

        if robot:
            show_visual = True if show_visual is None else show_visual
            configuration = configuration or robot.zero_configuration()

            robot.update(configuration, visual=show_visual, collision=show_collision)
            compas_frames = robot.transformed_frames(configuration, group)

            if show_visual:               
                visual = robot.artist.draw_visual()
                

            if show_collision:
                collision = robot.artist.draw_collision()

            if show_base_frame:
                base_compas_frame = compas_frames[0]
                artist = FrameArtist(base_compas_frame)
                base_frame = artist.draw()

            if show_end_effector_frame:
                ee_compas_frame = robot.forward_kinematics(configuration, group, options=dict(solver='model'))
                if robot.attached_tool:
                    ee_compas_frame = robot.from_t0cf_to_tcf([ee_compas_frame])[0]
                artist = FrameArtist(ee_compas_frame)
                ee_frame = artist.draw()

            if show_frames:
                frames = []
                for compas_frame in compas_frames[1:]:
                    artist = FrameArtist(compas_frame)
                    frame = artist.draw()
                    frames.append(frame)

            if show_acm:
                attached_meshes = []
                for acm in attached_collision_meshes:
                    frame = robot.forward_kinematics(configuration, options=dict(solver='model', link_name=acm.link_name))
                    T = Transformation.from_frame_to_frame(Frame.worldXY(), frame)
                    mesh = acm.collision_mesh.mesh.transformed(T)
                    attached_meshes.append(MeshArtist(mesh).draw())

        return (visual, collision, attached_meshes, frames, base_frame, ee_frame)
# ---------- end robot_visualize ----------
draw = GhPythonScript(frames=[robot_visualize.frames, robot_visualize.base_frame, robot_visualize.ee_frame], scale=Slider(0.2, range=0..1))  # -> P, V, C, W; inputs frames: list
# ---------- draw: Python ----------
from System.Drawing import Color
from compas_ghpython.artists import FrameArtist

red = Color.FromArgb(255, 0, 0)
green = Color.FromArgb(0, 255, 0)
blue = Color.FromArgb(0, 0, 255)

P = []
V = []
C = []

scale = float(scale)

for plane in frames:
    if not plane:
        continue
    P += [plane.Origin] * 3
    V.append(plane.XAxis * scale)
    V.append(plane.YAxis * scale)
    V.append(plane.ZAxis * scale)
    C += [red, green, blue]

W = 3
# ---------- end draw ----------
geo = Geometry([robot_visualize.visual, robot_visualize.collision, robot_visualize.attached_meshes])
preview_2 = CustomPreview(Geometry=geo, Shader=ColourSwatch(SwatchColor=RGB(207, 157, 160)))
vdisex = VectorDisplayEx(Point=draw.P, Vector=draw.V, Colour=draw.C, Width=draw.W)

# ==== cluster Cluster

# ---- group: measurement tool
geo = Geometry(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)
mesh = Mesh(geo)
mjoin = MeshJoin(Meshes=mesh)
xaxis_line = Curve(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)
yaxis_line = Curve(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)
tool = PythonScript(rhmesh=mjoin, xline=xaxis_line, yline=yaxis_line)  # -> tool, ee_mesh; inputs rhmesh: Mesh
# ---------- tool: Python ----------
import Rhino.Geometry as rg
import os, math
from compas.geometry import Frame, Rotation
from compas.datastructures import Mesh
from compas_ghpython.artists import MeshArtist
from compas_fab.robots import Tool
from compas_rhino.geometry import RhinoMesh

xaxis = rg.Line(xline.PointAtStart, xline.PointAtEnd)
yaxis = rg.Line(yline.PointAtStart, yline.PointAtEnd)

if xaxis.From.DistanceTo(yaxis.From) < 0.01:
    origin = xaxis.From
    xaxis = xaxis.Direction
    yaxis = yaxis.Direction
elif xaxis.To.DistanceTo(yaxis.To) < 0.01:
    origin = xaxis.To
    xaxis = -xaxis.Direction
    yaxis = -yaxis.Direction
elif xaxis.From.DistanceTo(yaxis.To) < 0.01:
    origin = xaxis.From
    xaxis = xaxis.Direction
    yaxis = -yaxis.Direction
elif xaxis.To.DistanceTo(yaxis.From) < 0.01:
    origin = xaxis.To
    xaxis = -xaxis.Direction
    yaxis = yaxis.Direction

xaxis.Unitize()
yaxis.Unitize()

ee_frame = Frame(origin, xaxis, yaxis)
ee_mesh = RhinoMesh.from_geometry(rhmesh).to_compas()

tool = Tool(ee_mesh, ee_frame)
# ---------- end tool ----------

# ---- group: concrete extruder tool
geo_2 = Geometry(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)
mesh_2 = Mesh(geo_2)
mjoin_2 = MeshJoin(Meshes=mesh_2)
xaxis_line_2 = Curve(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)
yaxis_line_2 = Curve(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)

# ----
tool_choice = ClusterInput()
tool_2 = PythonScript(rhmesh=mjoin_2, xline=xaxis_line_2, yline=yaxis_line_2)  # -> tool, ee_mesh; inputs rhmesh: Mesh; same code as tool
tool_choice_2 = Data(tool_choice)
filter = StreamFilter(Gate=tool_choice_2, Stream0=tool.tool, Stream1=tool_2.tool)
filter_2 = StreamFilter(Gate=tool_choice_2, Stream0=tool.ee_mesh, Stream1=tool_2.ee_mesh)
tool_3 = Data(filter)
mesh_3 = Data(filter_2)
tool_4 = ClusterOutput(tool_3)
mesh_4 = ClusterOutput(mesh_3)
