# Grasshopper definition crb15000_demo.ghx (Grasshopper 1.0.7)

pt = Point([<point referenced from the Rhino model> x3])
pointstoframes = GhPythonScript(points=pt)  # -> out, frames; inputs points: list of Point3d
# ---------- pointstoframes: Python ----------
__author__ = "julia"
__version__ = "2022.04.12"

import rhinoscriptsyntax as rs
from compas.geometry import Point, Frame, Vector

vector1 = Vector(-1,0,0)
vector2 = Vector(0,1,0)

frames = []

for point in points:
    frame_point = Point(point[0]*1000, point[1]*1000, point[2]*1000)
    print(frame_point)
    frame = Frame(frame_point, vector1, vector2)
    frames.append(frame)
# ---------- end pointstoframes ----------
enabled = Button()
rrc = GhPythonScript(enabled=enabled, frames=pointstoframes.frames)  # -> out, a; inputs enabled: Boolean, frames: list
# ---------- rrc: Python ----------
__author__ = "julia"
__version__ = "2022.04.12"

from compas.geometry import Frame, Point, Vector
import compas_rrc as rrc


if enabled:
    # Create Ros Client
    ros = rrc.RosClient()
    ros.run()

    # Create ABB Client
    abb = rrc.AbbClient(ros, '/rob1')
    print('Connected.')

    # Set tool
    abb.send(rrc.SetTool('tool0'))

    # Set work object
    abb.send(rrc.SetWorkObject('wobj0'))


    # Set speed [mm/s]
    speed = 100
    
    for frame in frames:
        done = abb.send_and_wait(rrc.MoveToFrame(frame, speed, rrc.Zone.FINE, rrc.Motion.LINEAR), timeout=20)
        # Print feedback 
        print('Feedback = ', done)

    # End of Code
    print('Finished')

    # Close client
    ros.close()
    ros.terminate()
# ---------- end rrc ----------
rec = DataRecorder(rrc.out, DataLimit=-10, RecordData=True)
panel = Panel(rec)
